# Grasshopper definition ScriptValidationTests.gh (Grasshopper 1.0.8)
# plug-ins: RhinoCodePluginGH, Hops, MetaHopper

panel = Panel("""{
  "nodes": [
    {
      "id": "slider_x",
      "guid": "57da07bd-ecab-415d-9d86-af36d7073abc",
      "nickname": "X",
      "x": 40,
      "y": 40,
      "properties": { "Min": -10.0, "Max": 10.0, "Value": 2.0 }
    },
    {
      "id": "slider_y",
      "guid": "57da07bd-ecab-415d-9d86-af36d7073abc",
      "nickname": "Y",
      "x": 40,
      "y": 100,
      "properties": { "Min": -10.0, "Max": 10.0, "Value": 1.0 }
    },
    {
      "id": "slider_z",
      "guid": "57da07bd-ecab-415d-9d86-af36d7073abc",
      "nickname": "Z",
      "x": 40,
      "y": 160,
      "properties": { "Min": -10.0, "Max": 10.0, "Value": 0.0 }
    },
    {
      "id": "slider_r",
      "guid": "57da07bd-ecab-415d-9d86-af36d7073abc",
      "nickname": "R",
      "x": 40,
      "y": 220,
      "properties": { "Min": 0.1, "Max": 10.0, "Value": 3.0 }
    },
    {
      "id": "pt",
      "guid": "3581f42a-9592-4549-bd6b-1c0fc39d067b",
      "nickname": "Pt",
      "x": 260,
      "y": 100
    },
    {
      "id": "box",
      "guid": "28061aae-04fb-4cb5-ac45-16f3b66bc0a4",
      "nickname": "Box",
      "x": 460,
      "y": 60
    },
    {
      "id": "sphere",
      "guid": "dabc854d-f50e-408a-b001-d043c7de151d",
      "nickname": "Sph",
      "x": 460,
      "y": 180
    },
    {
      "id": "sdiff",
      "guid": "fab11c30-2d9c-4d15-ab3c-2289f1ae5c21",
      "nickname": "SDiff",
      "x": 680,
      "y": 120
    }
  ],
  "links": [
    { "fromNode": "slider_x", "fromParam": "0",  "toNode": "pt",     "toParam": "X" },
    { "fromNode": "slider_y", "fromParam": "0",  "toNode": "pt",     "toParam": "Y" },
    { "fromNode": "slider_z", "fromParam": "0",  "toNode": "pt",     "toParam": "Z" },

    { "fromNode": "pt",       "fromParam": "Pt", "toNode": "sphere", "toParam": "0" },
    { "fromNode": "slider_r", "fromParam": "0",  "toNode": "sphere", "toParam": "R" },

    { "fromNode": "pt",       "fromParam": "Pt", "toNode": "box",    "toParam": "0" },
    { "fromNode": "slider_r", "fromParam": "0",  "toNode": "box",    "toParam": "X" },
    { "fromNode": "slider_r", "fromParam": "0",  "toNode": "box",    "toParam": "Y" },
    { "fromNode": "slider_r", "fromParam": "0",  "toNode": "box",    "toParam": "Z" },

    { "fromNode": "sphere",   "fromParam": "S",  "toNode": "sdiff",  "toParam": "A" },
    { "fromNode": "box",      "fromParam": "B",  "toNode": "sdiff",  "toParam": "0" }
  ]
}""")
panel_2 = Panel("C:\Root\Github\GH-Web-App\backend-compute-gateway\src\scripts\test-script-geometry.gh")
example = Panel("""{
  "nodes": [
    {
      "id": "slider_x",
      "guid": "57da07bd-ecab-415d-9d86-af36d7073abc",
      "nickname": "X",
      "x": 40,
      "y": 40,
      "properties": { "Min": -10.0, "Max": 10.0, "Value": 2.0 }
    },
    {
      "id": "slider_y",
      "guid": "57da07bd-ecab-415d-9d86-af36d7073abc",
      "nickname": "Y",
      "x": 40,
      "y": 100,
      "properties": { "Min": -10.0, "Max": 10.0, "Value": 1.0 }
    },
    {
      "id": "slider_z",
      "guid": "57da07bd-ecab-415d-9d86-af36d7073abc",
      "nickname": "Z",
      "x": 40,
      "y": 160,
      "properties": { "Min": -10.0, "Max": 10.0, "Value": 0.0 }
    },
    {
      "id": "slider_r",
      "guid": "57da07bd-ecab-415d-9d86-af36d7073abc",
      "nickname": "R",
      "x": 40,
      "y": 220,
      "properties": { "Min": 0.1, "Max": 10.0, "Value": 3.0 }
    },
    {
      "id": "pt",
      "guid": "3581f42a-9592-4549-bd6b-1c0fc39d067b",
      "nickname": "Pt",
      "x": 260,
      "y": 100
    },
    {
      "id": "box",
      "guid": "28061aae-04fb-4cb5-ac45-16f3b66bc0a4",
      "nickname": "Box",
      "x": 460,
      "y": 60
    },
    {
      "id": "sphere",
      "guid": "dabc854d-f50e-408a-b001-d043c7de151d",
      "nickname": "Sph",
      "x": 460,
      "y": 180
    },
    {
      "id": "sdiff",
      "guid": "fab11c30-2d9c-4d15-ab3c-2289f1ae5c21",
      "nickname": "SDiff",
      "x": 680,
      "y": 120
    }
  ],
  "links": [
    { "fromNode": "slider_x", "fromParam": "0",  "toNode": "pt",     "toParam": "X" },
    { "fromNode": "slider_y", "fromParam": "0",  "toNode": "pt",     "toParam": "Y" },
    { "fromNode": "slider_z", "fromParam": "0",  "toNode": "pt",     "toParam": "Z" },

    { "fromNode": "pt",       "fromParam": "Pt", "toNode": "sphere", "toParam": "B" },
    { "fromNode": "slider_r", "fromParam": "0",  "toNode": "sphere", "toParam": "R" },

    { "fromNode": "pt",       "fromParam": "Pt", "toNode": "box",    "toParam": "B" },
    { "fromNode": "slider_r", "fromParam": "0",  "toNode": "box",    "toParam": "X" },
    { "fromNode": "slider_r", "fromParam": "0",  "toNode": "box",    "toParam": "Y" },
    { "fromNode": "slider_r", "fromParam": "0",  "toNode": "box",    "toParam": "Z" },

    { "fromNode": "sphere",   "fromParam": "S",  "toNode": "sdiff",  "toParam": "A" },
    { "fromNode": "box",      "fromParam": "B",  "toNode": "sdiff",  "toParam": "B" }
  ]
}""")
c_script = CSharpScript(x=panel_2)  # -> out, A
# ---------- c_script: C# ----------
// Grasshopper C# Script - .gh -> Base64
// Input:  x  (string)  -> full path to .gh file
// Output: A  (string)  -> Base64 representation of the file

using System;
using System.IO;

using Rhino;
using Rhino.Geometry;

using Grasshopper;
using Grasshopper.Kernel;
using Grasshopper.Kernel.Data;
using Grasshopper.Kernel.Types;

public class Script_Instance : GH_ScriptInstance
{
  /// <summary>
  /// This procedure contains the user code. Input parameters are provided as regular arguments,
  /// Output parameters as ref arguments.
  /// </summary>
  private void RunScript(object x, ref object A)
  {
    // --- 0. Get and validate input path ---
    string ghPath = x as string;

    if (string.IsNullOrWhiteSpace(ghPath))
    {
      A = "Please provide a .gh file path into input x.";
      return;
    }

    // Clean up quotes if the path came from a panel with quotes
    ghPath = ghPath.Trim('"');

    if (!File.Exists(ghPath))
    {
      A = $"File not found: {ghPath}";
      return;
    }

    try
    {
      // --- 1. Read file bytes ---
      byte[] fileBytes = File.ReadAllBytes(ghPath);

      // --- 2. Convert to Base64 ---
      string base64 = Convert.ToBase64String(fileBytes);

      // --- 3. Output ---
      A = base64;
    }
    catch (Exception ex)
    {
      A = $"Error reading or converting file: {ex.Message}";
    }
  }
}
# ---------- end c_script ----------
hops = Hops(
    GetString=c_script.A,
    CacheResultsInMemory=True,
    CacheSolveResults=True,
    RemoteDefinitionLocation="C:\Root\Github\GH-Web-App\backend-compute-gateway\src\scripts\compute-gh-to-json.gh",
    RemoteSolveVersion=(0, 1, 0),
    ShowInput_Enabled=False,
    ShowInput_Path=False,
    SynchronousSolve=True)  # -> Gh_json, Validation_msg
c_script_2 = CSharpScript(ghBase64Input=c_script.A)  # -> out, A; disabled
# ---------- c_script_2: C# ----------
// r "C:\\Program Files\\Rhino 8\\System\\Newtonsoft.Json.dll"

using System;
using System.IO;
using System.Collections.Generic;
using System.Linq;
using Grasshopper;
using Grasshopper.Kernel;
using Grasshopper.Kernel.Parameters;
using Grasshopper.Kernel.Special;
using GH_IO.Serialization;
using Newtonsoft.Json.Linq;

public class Script_Instance : GH_ScriptInstance
{
  private void RunScript(object ghBase64Input, ref object A)
  {
    // --- 0. Get and validate Base64 input ---
    string base64 = ghBase64Input as string;
    if (string.IsNullOrWhiteSpace(base64))
    {
      A = "Please provide a Base64-encoded .gh binary into input x.";
      return;
    }

    base64 = base64.Trim('"' );

    byte[] data;
    try
    {
      data = Convert.FromBase64String(base64);
    }
    catch (Exception ex)
    {
      A = "Input is not valid Base64: " + ex.Message;
      return;
    }

    // --- 1. Load GH document from Base64 in memory ---
    var archive = new GH_Archive();
    bool ok = archive.Deserialize_Binary(data);
    if (!ok)
    {
      A = "Failed to deserialize GH binary from Base64.";
      return;
    }

    var doc = new GH_Document();
    if (!archive.ExtractObject(doc, "Definition"))
    {
      A = "Failed to extract GH document from archive (expected root 'Definition').";
      return;
    }

    // --- 2. Collect nodes we care about (components + floating params) ---
    var orderedObjects = new List<IGH_DocumentObject>();
    var nodeIdByObject = new Dictionary<IGH_DocumentObject, string>();
    var nicknameCount  = new Dictionary<string, int>();

    foreach (var obj in doc.Objects)
    {
      // Ignore groups, scribbles, etc.
      if (!(obj is IGH_Component) && !(obj is IGH_Param))
        continue;

      orderedObjects.Add(obj);

      string baseNick = !string.IsNullOrWhiteSpace(obj.NickName)
        ? obj.NickName
        : (!string.IsNullOrWhiteSpace(obj.Name) ? obj.Name : "Node");

      baseNick = SanitizeId(baseNick);

      int count;
      if (!nicknameCount.TryGetValue(baseNick, out count))
        count = 0;

      string id = (count == 0) ? baseNick : (baseNick + "_" + (count + 1));
      nicknameCount[baseNick] = count + 1;

      nodeIdByObject[obj] = id;
    }

    // --- 3. Build nodes array ---
    var nodesArray = new JArray();

    foreach (var obj in orderedObjects)
    {
      string id = nodeIdByObject[obj];

      var node = new JObject();
      node["id"] = id;

      // Component / param "definition" GUID
      Guid defGuid = Guid.Empty;
      var active = obj as IGH_ActiveObject;
      if (active != null)
        defGuid = active.ComponentGuid;

      node["guid"] = (defGuid == Guid.Empty ? obj.InstanceGuid : defGuid).ToString();
      node["nickname"] = obj.NickName;
      node["x"] = obj.Attributes.Pivot.X;
      node["y"] = obj.Attributes.Pivot.Y;

      JObject props = null;

      // Slider properties
      var slider = obj as GH_NumberSlider;
      if (slider != null)
      {
        props = props ?? new JObject();
        props["Min"]   = slider.Slider.Minimum;
        props["Max"]   = slider.Slider.Maximum;
        props["Value"] = slider.Slider.Value;
      }

      // Panel properties (text/content)
      var panel = obj as GH_Panel;
      if (panel != null)
      {
        props = props ?? new JObject();
        props["Text"] = panel.UserText;
      }

      if (props != null)
        node["properties"] = props;

      nodesArray.Add(node);
    }

    // --- 4. Build links array ---
    var linksArray = new JArray();

    // 4a. Component inputs (component / slider / param → component)
    foreach (var obj in orderedObjects)
    {
      var comp = obj as IGH_Component;
      if (comp == null)
        continue;

      string toNodeId = nodeIdByObject[obj];

      // use index instead of param name for input ports
      for (int inputIndex = 0; inputIndex < comp.Params.Input.Count; inputIndex++)
      {
        var inputParam   = comp.Params.Input[inputIndex];
        string toParamId = inputIndex.ToString();

        foreach (var srcParam in inputParam.Sources)
        {
          if (!TryResolveSource(srcParam, orderedObjects, nodeIdByObject,
                                out string fromNodeId, out string fromParamId))
            continue;

          var link = new JObject();
          link["fromNode"]  = fromNodeId;
          link["fromParam"] = fromParamId;  // "0" for floating params, index for components
          link["toNode"]    = toNodeId;
          link["toParam"]   = toParamId;    // input index

          linksArray.Add(link);
        }
      }
    }

    // 4b. Floating param inputs (component / slider / param → panel / other floating param)
    foreach (var obj in orderedObjects)
    {
      var param = obj as IGH_Param;
      if (param == null)
        continue;

      if (param.Sources.Count == 0)
        continue;

      string toNodeId  = nodeIdByObject[obj];
      string toParamId = "0"; // single implicit input index for floating params

      foreach (var srcParam in param.Sources)
      {
        if (!TryResolveSource(srcParam, orderedObjects, nodeIdByObject,
                              out string fromNodeId, out string fromParamId))
          continue;

        var link = new JObject();
        link["fromNode"]  = fromNodeId;
        link["fromParam"] = fromParamId;  // "0" or output index
        link["toNode"]    = toNodeId;
        link["toParam"]   = toParamId;    // "0" for floating param sinks

        linksArray.Add(link);
      }
    }

    // --- 5. Assemble root JSON ---
    var root = new JObject();
    root["nodes"] = nodesArray;
    root["links"] = linksArray;

    string json = root.ToString();

    // --- 6. Return JSON directly (no file I/O) ---
    A = json;
  }

  // --- helpers ---

  private static string SanitizeId(string s)
  {
    if (string.IsNullOrWhiteSpace(s))
      return "Node";

    var chars = s.ToCharArray();
    for (int i = 0; i < chars.Length; i++)
    {
      char c = chars[i];
      if (!(char.IsLetterOrDigit(c) || c == '_' || c == '-'))
        chars[i] = '_';
    }
    return new string(chars);
  }

  private static string SafeParamName(IGH_Param p)
  {
    if (!string.IsNullOrWhiteSpace(p.NickName))
      return p.NickName;
    if (!string.IsNullOrWhiteSpace(p.Name))
      return p.Name;
    return "P";
  }

  /// <summary>
  /// Resolve the source node + output param id for a given source param.
  /// - If srcParam is a floating param (slider, panel, etc.) that is a top-level doc object:
  ///     fromNodeId = that param's node id, fromParamId = "0"
  /// - If srcParam is a component output:
  ///     fromNodeId = component's node id, fromParamId = output index ("0","1",...)
  /// </summary>
  private static bool TryResolveSource(
    IGH_Param srcParam,
    List<IGH_DocumentObject> orderedObjects,
    Dictionary<IGH_DocumentObject, string> nodeIdByObject,
    out string fromNodeId,
    out string fromParamId)
  {
    fromNodeId  = null;
    fromParamId = null;

    // Case 1: srcParam itself is a top-level IGH_DocumentObject (slider, panel, floating param)
    var srcDocObj = srcParam as IGH_DocumentObject;
    if (srcDocObj != null && nodeIdByObject.TryGetValue(srcDocObj, out fromNodeId))
    {
      fromParamId = "0"; // single output index
      return true;
    }

    // Case 2: srcParam belongs to a component's Outputs
    foreach (var obj in orderedObjects)
    {
      var comp = obj as IGH_Component;
      if (comp == null)
        continue;

      int idx = comp.Params.Output.IndexOf(srcParam);
      if (idx >= 0)
      {
        fromNodeId  = nodeIdByObject[comp];
        fromParamId = idx.ToString();
        return true;
      }
    }

    // Could not resolve source node
    return false;
  }
}
# ---------- end c_script_2 ----------
c_script_3 = CSharpScript(x=c_script_2.A)  # -> out, a, b, c; inputs x: String; disabled
# ---------- c_script_3: C# ----------
#r "C:\Program Files\Rhino 8\System\Newtonsoft.Json.dll"
#r "C:\Program Files\Rhino 8\Plug-ins\Grasshopper\GH_IO.dll"

// Grasshopper Script Instance
#region Usings
using System;
using System.IO;
using System.Linq;
using System.Collections;
using System.Collections.Generic;
using System.Drawing;
using System.Globalization;

using Rhino;
using Rhino.Geometry;

using Grasshopper;
using Grasshopper.Kernel;
using Grasshopper.Kernel.Data;
using Grasshopper.Kernel.Types;
using Grasshopper.Kernel.Special;

using GH_IO.Serialization;

using Newtonsoft.Json;
#endregion

public class Script_Instance : GH_ScriptInstance
{
    #region Notes
    /* 
      Members:
        RhinoDoc RhinoDocument
        GH_Document GrasshopperDocument
        IGH_Component Component
        int Iteration

      Methods (Virtual & overridable):
        Print(string text)
        Print(string format, params object[] args)
        Reflect(object obj)
        Reflect(object obj, string method_name)
    */
    #endregion

    // Inputs:
    //   x: string (JSON definition)
    //
    // Outputs:
    //   a: Base64 string of the generated .gh file (binary)
    //   b: Debug log messages (list of strings)
    //   c: Summary string (node/link counts, failed links)
    private void RunScript(string x, ref object a, ref object b, ref object c)
    {
        if (string.IsNullOrWhiteSpace(x))
        {
            a = "No JSON string provided.";
            b = null;
            c = null;
            return;
        }

        var logs = new List<string>();

        try
        {
            int nodeCount, linkCount, failedLinks;
            string base64Gh = GhGenerator.GenerateBase64FromJson(
                x,
                msg =>
                {
                    logs.Add(msg);
                    Rhino.RhinoApp.WriteLine(msg);
                },
                out nodeCount,
                out linkCount,
                out failedLinks
            );

            a = base64Gh;
            b = logs;
            c = $"Nodes: {nodeCount}, Links: {linkCount}, FailedLinks: {failedLinks}";
        }
        catch (Exception ex)
        {
            a = "Error:\n" + ex;
            b = logs;
            c = "Error encountered while generating GH document.";
        }
    }

    #region Additional

    // ---------- JSON models ----------

    public class GhDefinitionJson
    {
        public List<NodeJson> nodes { get; set; }
        public List<LinkJson> links { get; set; }
    }

    public class NodeJson
    {
        public string id { get; set; }

        // Preferred: GH component/param GUID, e.g. "28061aae-04fb-4cb5-ac45-16f3b66bc0a4"
        public string guid { get; set; }

        // Optional fallback: .NET type name (assembly-qualified or resolvable by Type.GetType)
        public string type { get; set; }

        public string nickname { get; set; }
        public float x { get; set; }
        public float y { get; set; }
        public Dictionary<string, object> properties { get; set; }
    }

    public class LinkJson
    {
        public string fromNode { get; set; }
        public string fromParam { get; set; }      // output param nickname or index as string
        public string toNode { get; set; }
        public string toParam { get; set; }        // input param nickname or index as string
    }

    // ---------- Generator core ----------

    public static class GhGenerator
    {
        /// <summary>
        /// Takes a JSON string definition and returns a Base64-encoded binary .gh file.
        /// Also returns node/link counts and number of failed links.
        /// </summary>
        public static string GenerateBase64FromJson(
            string json,
            Action<string> log,
            out int nodeCount,
            out int linkCount,
            out int failedLinks
        )
        {
            nodeCount   = 0;
            linkCount   = 0;
            failedLinks = 0;

            var def = JsonConvert.DeserializeObject<GhDefinitionJson>(json);
            if (def == null)
                throw new Exception("Failed to deserialize JSON.");

            var doc = new GH_Document();
            var nodeMap = new Dictionary<string, IGH_DocumentObject>();

            // 1. Create nodes
            foreach (var node in def.nodes ?? new List<NodeJson>())
            {
                var obj = CreateObjectFromNode(node, log);
                if (obj == null)
                {
                    log?.Invoke($"[GHGen] Skipping node '{node.id}' (could not create object).");
                    continue;
                }

                // UI attributes & position
                obj.CreateAttributes();
                obj.Attributes.Pivot = new PointF(node.x, node.y);

                if (!string.IsNullOrEmpty(node.nickname))
                {
                    obj.NickName = node.nickname;
                    obj.Name = node.nickname;
                }

                doc.AddObject(obj, false);
                ApplyNodeProperties(obj, node.properties, log);

                nodeMap[node.id] = obj;
                nodeCount++;
            }

            // 2. Create links (wires)
            foreach (var link in def.links ?? new List<LinkJson>())
            {
                linkCount++;

                if (!nodeMap.TryGetValue(link.fromNode, out var fromObj))
                {
                    log?.Invoke($"[GHGen] Link skipped: fromNode '{link.fromNode}' not found.");
                    failedLinks++;
                    continue;
                }

                if (!nodeMap.TryGetValue(link.toNode, out var toObj))
                {
                    log?.Invoke($"[GHGen] Link skipped: toNode '{link.toNode}' not found.");
                    failedLinks++;
                    continue;
                }

                var fromParam = ResolveOutputParam(fromObj, link.fromParam);
                if (fromParam == null)
                {
                    log?.Invoke(
                        $"[GHGen] Link skipped: fromParam '{link.fromParam}' not resolved on node '{link.fromNode}'.");
                    failedLinks++;
                    continue;
                }

                var toParam = ResolveInputParam(toObj, link.toParam);
                if (toParam == null)
                {
                    log?.Invoke(
                        $"[GHGen] Link skipped: toParam '{link.toParam}' not resolved on node '{link.toNode}'.");
                    failedLinks++;
                    continue;
                }

                // Connect source to target input
                toParam.AddSource(fromParam);
            }

            // 3. Serialize to binary GH in memory and encode as Base64
            var archive = new GH_Archive();
            archive.AppendObject(doc, "Definition");

            byte[] ghBytes = archive.Serialize_Binary();
            if (ghBytes == null || ghBytes.Length == 0)
                throw new Exception("Failed to serialize GH document to binary.");

            return Convert.ToBase64String(ghBytes);
        }

        // ---------- Helpers ----------

        private static IGH_DocumentObject CreateObjectFromNode(NodeJson node, Action<string> log)
        {
            if (node == null)
                return null;

            // 1) Preferred: instantiate by GH object GUID via ComponentServer
            if (!string.IsNullOrEmpty(node.guid))
            {
                if (Guid.TryParse(node.guid, out var g))
                {
                    var objFromGuid = Instances.ComponentServer.EmitObject(g);
                    if (objFromGuid != null)
                        return objFromGuid;

                    log?.Invoke("[GHGen] Could not instantiate object for GUID: " + node.guid);
                }
                else
                {
                    log?.Invoke("[GHGen] Invalid GUID string: " + node.guid);
                }
            }

            // 2) Fallback: instantiate by .NET type if provided
            if (!string.IsNullOrEmpty(node.type))
            {
                var t = Type.GetType(node.type, false);
                if (t == null)
                {
                    log?.Invoke("[GHGen] Could not resolve type: " + node.type);
                    return null;
                }

                try
                {
                    var instance = Activator.CreateInstance(t) as IGH_DocumentObject;
                    if (instance == null)
                        log?.Invoke("[GHGen] Type is not IGH_DocumentObject: " + node.type);

                    return instance;
                }
                catch (Exception ex)
                {
                    log?.Invoke("[GHGen] Error creating type " + node.type + ": " + ex.Message);
                    return null;
                }
            }

            log?.Invoke("[GHGen] Node has neither valid guid nor type: " + (node.id ?? "<no id>"));
            return null;
        }

        private static void ApplyNodeProperties(IGH_DocumentObject obj, Dictionary<string, object> props, Action<string> log)
        {
            if (obj == null || props == null || props.Count == 0)
                return;

            // Number slider example
            if (obj is GH_NumberSlider slider)
            {
                if (props.TryGetValue("Min", out var minObj) && TryGetDecimal(minObj, out var min))
                    slider.Slider.Minimum = min;

                if (props.TryGetValue("Max", out var maxObj) && TryGetDecimal(maxObj, out var max))
                    slider.Slider.Maximum = max;

                if (props.TryGetValue("Value", out var valObj) && TryGetDecimal(valObj, out var val))
                    slider.Slider.Value = val;
            }

            // Panel example
            if (obj is GH_Panel panel)
            {
                if (props.TryGetValue("Text", out var textObj))
                    panel.UserText = textObj.ToString();
            }

            // Extend with more component-specific cases as needed.
        }

        private static bool TryGetDecimal(object input, out decimal result)
        {
            if (input == null)
            {
                result = 0m;
                return false;
            }

            if (input is decimal d)
            {
                result = d;
                return true;
            }

            if (input is double dbl)
            {
                result = (decimal)dbl;
                return true;
            }

            if (input is float fl)
            {
                result = (decimal)fl;
                return true;
            }

            if (input is int i)
            {
                result = i;
                return true;
            }

            if (input is long l)
            {
                result = l;
                return true;
            }

            return decimal.TryParse(
                input.ToString(),
                NumberStyles.Any,
                CultureInfo.InvariantCulture,
                out result
            );
        }

        // Output param: components or single-parameter objects (sliders, panels)
        private static IGH_Param ResolveOutputParam(IGH_DocumentObject obj, string key)
        {
            // Floating param as owner → just return that param
            if (obj is IGH_Param pParam)
                return pParam;

            if (obj is IGH_Component comp)
                return FindOutputParam(comp, key);

            return null;
        }

        // Input param: components or single-parameter objects (panels, value params)
        private static IGH_Param ResolveInputParam(IGH_DocumentObject obj, string key)
        {
            // Floating param as sink → just return that param (ignores key)
            if (obj is IGH_Param pParam)
                return pParam;

            if (obj is IGH_Component comp)
                return FindInputParam(comp, key);

            return null;
        }

        private static IGH_Param FindOutputParam(IGH_Component comp, string key)
        {
            if (comp == null || comp.Params.Output.Count == 0)
                return null;

            // index-based lookup first
            if (int.TryParse(key, out int index))
            {
                if (index >= 0 && index < comp.Params.Output.Count)
                    return comp.Params.Output[index];
            }

            // fallback: nickname / name
            return comp.Params.Output.FirstOrDefault(p =>
                string.Equals(p.NickName, key, StringComparison.OrdinalIgnoreCase) ||
                string.Equals(p.Name, key, StringComparison.OrdinalIgnoreCase));
        }

        private static IGH_Param FindInputParam(IGH_Component comp, string key)
        {
            if (comp == null || comp.Params.Input.Count == 0)
                return null;

            // index-based lookup first
            if (int.TryParse(key, out int index))
            {
                if (index >= 0 && index < comp.Params.Input.Count)
                    return comp.Params.Input[index];
            }

            // fallback: nickname / name
            return comp.Params.Input.FirstOrDefault(p =>
                string.Equals(p.NickName, key, StringComparison.OrdinalIgnoreCase) ||
                string.Equals(p.Name, key, StringComparison.OrdinalIgnoreCase));
        }
    }

    #endregion
}
# ---------- end c_script_3 ----------
relative_path = RelativePath(Path="json-originated-gh-4.gh")
hops_2 = Hops(
    GetString=hops.Gh_json,
    CacheResultsInMemory=True,
    CacheSolveResults=True,
    RemoteDefinitionLocation="C:\Root\Github\GH-Web-App\backend-compute-gateway\src\scripts\compute-json-to-gh.gh",
    RemoteSolveVersion=(0, 1, 0),
    ShowInput_Enabled=False,
    ShowInput_Path=False,
    SynchronousSolve=True)  # -> Gh_file_msg, Gh_file, Validation_msg
panel_3 = Panel(c_script_3.c)  # disabled
c_script_4 = CSharpScript(b64=hops_2.Gh_file, path=relative_path)  # -> out, A; inputs b64: String, path: String
# ---------- c_script_4: C# ----------
// Usings
using System;
using System.IO;

public class Script_Instance : GH_ScriptInstance
{
  private void RunScript(string b64, string path, ref object A)
  {
    // --- 0. Basic validation ---
    if (string.IsNullOrWhiteSpace(b64))
    {
      A = "Error: base64 input is empty.";
      return;
    }

    if (string.IsNullOrWhiteSpace(path))
    {
      A = "Error: file path is empty.";
      return;
    }

    // Clean up path (strip quotes/whitespace)
    path = path.Trim().Trim('"');

    try
    {
      // --- 1. Handle data-URI style base64, if present ---
      // e.g. "data:application/octet-stream;base64,AAAA..."
      int commaIndex = b64.IndexOf(',');
      if (commaIndex >= 0)
        b64 = b64.Substring(commaIndex + 1);

      // --- 2. Decode base64 ---
      byte[] data = Convert.FromBase64String(b64);

      // --- 3. Ensure directory exists ---
      string dir = Path.GetDirectoryName(path);
      if (!string.IsNullOrEmpty(dir) && !Directory.Exists(dir))
        Directory.CreateDirectory(dir);

      // --- 4. Write file ---
      File.WriteAllBytes(path, data);

      A = $"OK: Saved {data.Length} bytes to \"{path}\".";
    }
    catch (FormatException fex)
    {
      A = "Error: invalid base64 string.\n" + fex.Message;
    }
    catch (Exception ex)
    {
      A = "Error writing file:\n" + ex.Message;
    }
  }
}
# ---------- end c_script_4 ----------
