# Grasshopper definition compute-gh-to-json.gh (Grasshopper 1.0.8)
# plug-ins: RhinoCodePluginGH

panel = Panel("\"C:\\Users\\abawiskar\\Documents\\GitHub\\GH-Web-App\\gh file parser\\test_input_gh_02.gh\"")  # disabled
panel_2 = Panel("C:\Root\Github\GH-Web-App\backend-compute-gateway\src\scripts\test-script-geometry.gh")
get_string = GetString(AtLeast=1, AtMost=1, TreeAccess=False)
c_script = CSharpScript()  # -> out, A; disabled
# ---------- c_script: C# ----------
// r "C:\\Program Files\\Rhino 8\\System\\Newtonsoft.Json.dll"

using System;
using System.IO;
using System.Collections.Generic;
using System.Linq;
using Grasshopper;
using Grasshopper.Kernel;
using Grasshopper.Kernel.Parameters;
using Grasshopper.Kernel.Special;
using GH_IO.Serialization;
using Newtonsoft.Json.Linq;

public class Script_Instance : GH_ScriptInstance
{
  private void RunScript(object ghBase64Input, ref object A)
  {
    // --- 0. Get and validate Base64 input ---
    string base64 = ghBase64Input as string;
    if (string.IsNullOrWhiteSpace(base64))
    {
      A = "Please provide a Base64-encoded .gh binary into input x.";
      return;
    }

    base64 = base64.Trim('"' );

    byte[] data;
    try
    {
      data = Convert.FromBase64String(base64);
    }
    catch (Exception ex)
    {
      A = "Input is not valid Base64: " + ex.Message;
      return;
    }

    // --- 1. Load GH document from Base64 in memory ---
    var archive = new GH_Archive();
    bool ok = archive.Deserialize_Binary(data);
    if (!ok)
    {
      A = "Failed to deserialize GH binary from Base64.";
      return;
    }

    var doc = new GH_Document();
    if (!archive.ExtractObject(doc, "Definition"))
    {
      A = "Failed to extract GH document from archive (expected root 'Definition').";
      return;
    }

    // --- 2. Collect nodes we care about (components + floating params) ---
    var orderedObjects = new List<IGH_DocumentObject>();
    var nodeIdByObject = new Dictionary<IGH_DocumentObject, string>();
    var nicknameCount  = new Dictionary<string, int>();

    foreach (var obj in doc.Objects)
    {
      // Ignore groups, scribbles, etc.
      if (!(obj is IGH_Component) && !(obj is IGH_Param))
        continue;

      orderedObjects.Add(obj);

      string baseNick = !string.IsNullOrWhiteSpace(obj.NickName)
        ? obj.NickName
        : (!string.IsNullOrWhiteSpace(obj.Name) ? obj.Name : "Node");

      baseNick = SanitizeId(baseNick);

      int count;
      if (!nicknameCount.TryGetValue(baseNick, out count))
        count = 0;

      string id = (count == 0) ? baseNick : (baseNick + "_" + (count + 1));
      nicknameCount[baseNick] = count + 1;

      nodeIdByObject[obj] = id;
    }

    // --- 3. Build nodes array ---
    var nodesArray = new JArray();

    foreach (var obj in orderedObjects)
    {
      string id = nodeIdByObject[obj];

      var node = new JObject();
      node["id"] = id;

      // Component / param "definition" GUID
      Guid defGuid = Guid.Empty;
      var active = obj as IGH_ActiveObject;
      if (active != null)
        defGuid = active.ComponentGuid;

      node["guid"] = (defGuid == Guid.Empty ? obj.InstanceGuid : defGuid).ToString();
      node["nickname"] = obj.NickName;
      node["x"] = obj.Attributes.Pivot.X;
      node["y"] = obj.Attributes.Pivot.Y;

      JObject props = null;

      // Slider properties
      var slider = obj as GH_NumberSlider;
      if (slider != null)
      {
        props = props ?? new JObject();
        props["Min"]   = slider.Slider.Minimum;
        props["Max"]   = slider.Slider.Maximum;
        props["Value"] = slider.Slider.Value;
      }

      // Panel properties (text/content)
      var panel = obj as GH_Panel;
      if (panel != null)
      {
        props = props ?? new JObject();
        // "Text" matches what your importer expects for GH_Panel
        props["Text"] = panel.UserText;
      }

      if (props != null)
        node["properties"] = props;

      nodesArray.Add(node);
    }

    // --- 4. Build links array ---
    var linksArray = new JArray();

    // 4a. Component inputs (component / slider / param → component)
    foreach (var obj in orderedObjects)
    {
      var comp = obj as IGH_Component;
      if (comp == null)
        continue;

      string toNodeId = nodeIdByObject[obj];

      // use index instead of param name for input ports
      for (int inputIndex = 0; inputIndex < comp.Params.Input.Count; inputIndex++)
      {
        var inputParam   = comp.Params.Input[inputIndex];
        string toParamId = inputIndex.ToString();

        foreach (var srcParam in inputParam.Sources)
        {
          var srcOwner = srcParam.Attributes?.DocObject as IGH_DocumentObject;
          if (srcOwner == null)
            continue;

          if (!nodeIdByObject.TryGetValue(srcOwner, out string fromNodeId))
            continue;

          string fromParamId = GetFromParamId(srcOwner, srcParam);

          var link = new JObject();
          link["fromNode"]  = fromNodeId;
          link["fromParam"] = fromParamId;  // index (for components) or "0" (for single-output params)
          link["toNode"]    = toNodeId;
          link["toParam"]   = toParamId;    // input index

          linksArray.Add(link);
        }
      }
    }

    // 4b. Floating param inputs (component / slider / param → panel / other floating param)
    foreach (var obj in orderedObjects)
    {
      var param = obj as IGH_Param;
      if (param == null)
        continue;

      if (param.Sources.Count == 0)
        continue;

      string toNodeId   = nodeIdByObject[obj];
      string toParamId  = "0"; // single implicit input index for floating params

      foreach (var srcParam in param.Sources)
      {
        var srcOwner = srcParam.Attributes?.DocObject as IGH_DocumentObject;
        if (srcOwner == null)
          continue;

        if (!nodeIdByObject.TryGetValue(srcOwner, out string fromNodeId))
          continue;

        string fromParamId = GetFromParamId(srcOwner, srcParam);

        var link = new JObject();
        link["fromNode"]  = fromNodeId;
        link["fromParam"] = fromParamId;  // index or "0"
        link["toNode"]    = toNodeId;
        link["toParam"]   = toParamId;    // "0" for floating param sinks

        linksArray.Add(link);
      }
    }

    // --- 5. Assemble root JSON ---
    var root = new JObject();
    root["nodes"] = nodesArray;
    root["links"] = linksArray;

    string json = root.ToString();

    // --- 6. Return JSON directly (no file I/O) ---
    A = json;
  }

  // --- helpers ---

  private static string SanitizeId(string s)
  {
    if (string.IsNullOrWhiteSpace(s))
      return "Node";

    var chars = s.ToCharArray();
    for (int i = 0; i < chars.Length; i++)
    {
      char c = chars[i];
      if (!(char.IsLetterOrDigit(c) || c == '_' || c == '-'))
        chars[i] = '_';
    }
    return new string(chars);
  }

  private static string SafeParamName(IGH_Param p)
  {
    if (!string.IsNullOrWhiteSpace(p.NickName))
      return p.NickName;
    if (!string.IsNullOrWhiteSpace(p.Name))
      return p.Name;
    return "P";
  }

  /// <summary>
  /// Encodes the *output* side of a link.
  /// - For floating params (sliders, panels, value params): "0"
  /// - For components: output index ("0", "1", "2", ...)
  /// - Fallback: param nickname if index not found (rare / defensive)
  /// </summary>
  private static string GetFromParamId(IGH_DocumentObject owner, IGH_Param srcParam)
  {
    // Floating params (sliders, panels, GH_Param<>) – single output
    if (owner is IGH_Param && !(owner is IGH_Component))
      return "0";

    // Components – use index of output param
    var comp = owner as IGH_Component;
    if (comp != null)
    {
      int index = comp.Params.Output.IndexOf(srcParam);
      if (index >= 0)
        return index.ToString();
    }

    // Defensive fallback: name-based
    return SafeParamName(srcParam);
  }
}
# ---------- end c_script ----------
c_script_2 = CSharpScript()  # -> out, A; disabled
# ---------- c_script_2: C# ----------
// r "C:\\Program Files\\Rhino 8\\System\\Newtonsoft.Json.dll"

using System;
using System.IO;
using System.Collections.Generic;
using System.Linq;
using Grasshopper;
using Grasshopper.Kernel;
using Grasshopper.Kernel.Parameters;
using Grasshopper.Kernel.Special;
using GH_IO.Serialization;
using Newtonsoft.Json.Linq;

public class Script_Instance : GH_ScriptInstance
{
  private void RunScript(object ghBase64Input, ref object A)
  {
    // --- 0. Get and validate Base64 input ---
    string base64 = ghBase64Input as string;
    if (string.IsNullOrWhiteSpace(base64))
    {
      A = "Please provide a Base64-encoded .gh binary into input x.";
      return;
    }

    base64 = base64.Trim('"');

    byte[] data;
    try
    {
      data = Convert.FromBase64String(base64);
    }
    catch (Exception ex)
    {
      A = "Input is not valid Base64: " + ex.Message;
      return;
    }

    // --- 1. Load GH document from Base64 in memory ---
    var archive = new GH_Archive();
    bool ok = archive.Deserialize_Binary(data);
    if (!ok)
    {
      A = "Failed to deserialize GH binary from Base64.";
      return;
    }

    var doc = new GH_Document();
    if (!archive.ExtractObject(doc, "Definition"))
    {
      A = "Failed to extract GH document from archive (expected root 'Definition').";
      return;
    }

    // --- 2. Collect nodes we care about (components + floating params) ---
    var orderedObjects   = new List<IGH_DocumentObject>();
    var nodeIdByObject   = new Dictionary<IGH_DocumentObject, string>();
    var nicknameCount    = new Dictionary<string, int>();

    foreach (var obj in doc.Objects)
    {
      // Ignore groups, scribbles, etc.
      if (!(obj is IGH_Component) && !(obj is IGH_Param))
        continue;

      orderedObjects.Add(obj);

      string baseNick = !string.IsNullOrWhiteSpace(obj.NickName)
        ? obj.NickName
        : (!string.IsNullOrWhiteSpace(obj.Name) ? obj.Name : "Node");

      // sanitise a bit
      baseNick = SanitizeId(baseNick);

      int count;
      if (!nicknameCount.TryGetValue(baseNick, out count))
        count = 0;

      string id = (count == 0) ? baseNick : (baseNick + "_" + (count + 1));
      nicknameCount[baseNick] = count + 1;

      nodeIdByObject[obj] = id;
    }

    // --- 3. Build nodes array ---
    var nodesArray = new JArray();

    foreach (var obj in orderedObjects)
    {
      string id = nodeIdByObject[obj];

      var node = new JObject();
      node["id"] = id;

      // Component / param "definition" GUID
      Guid defGuid = Guid.Empty;
      var active = obj as IGH_ActiveObject;
      if (active != null)
        defGuid = active.ComponentGuid;

      node["guid"] = (defGuid == Guid.Empty ? obj.InstanceGuid : defGuid).ToString();
      node["nickname"] = obj.NickName;
      node["x"] = obj.Attributes.Pivot.X;
      node["y"] = obj.Attributes.Pivot.Y;

      // Optional properties block (e.g. sliders)
      var slider = obj as GH_NumberSlider;
      if (slider != null)
      {
        var p = new JObject();
        p["Min"]   = slider.Slider.Minimum;
        p["Max"]   = slider.Slider.Maximum;
        p["Value"] = slider.Slider.Value;
        node["properties"] = p;
      }

      // you could add more special cases (toggles, panels, etc.) here if desired

      nodesArray.Add(node);
    }

    // --- 4. Build links array ---
    var linksArray = new JArray();

    // 4a. Component inputs (component / slider / param → component)
    foreach (var obj in orderedObjects)
    {
      var comp = obj as IGH_Component;
      if (comp == null)
        continue;

      string toNodeId = nodeIdByObject[obj];

      // use index instead of param name for input ports
      for (int inputIndex = 0; inputIndex < comp.Params.Input.Count; inputIndex++)
      {
        var inputParam = comp.Params.Input[inputIndex];
        string toParamIndex = inputIndex.ToString();

        foreach (var srcParam in inputParam.Sources)
        {
          var srcOwner = srcParam.Attributes?.DocObject as IGH_DocumentObject;
          if (srcOwner == null)
            continue;

          string fromNodeId;
          if (!nodeIdByObject.TryGetValue(srcOwner, out fromNodeId))
            continue;

          string fromParamName = GetFromParamName(srcOwner, srcParam);

          var link = new JObject();
          link["fromNode"]  = fromNodeId;
          link["fromParam"] = fromParamName;
          link["toNode"]    = toNodeId;
          link["toParam"]   = toParamIndex; // index-based in-param

          linksArray.Add(link);
        }
      }
    }

    // 4b. Floating param inputs (component / slider / param → panel / other floating param)
    foreach (var obj in orderedObjects)
    {
      var param = obj as IGH_Param;
      if (param == null)
        continue;

      // if no sources, no incoming links
      if (param.Sources.Count == 0)
        continue;

      string toNodeId = nodeIdByObject[obj];

      // floating params effectively have a single input at index 0
      string toParamIndex = "0";

      foreach (var srcParam in param.Sources)
      {
        var srcOwner = srcParam.Attributes?.DocObject as IGH_DocumentObject;
        if (srcOwner == null)
          continue;

        string fromNodeId;
        if (!nodeIdByObject.TryGetValue(srcOwner, out fromNodeId))
          continue;

        string fromParamName = GetFromParamName(srcOwner, srcParam);

        var link = new JObject();
        link["fromNode"]  = fromNodeId;
        link["fromParam"] = fromParamName;
        link["toNode"]    = toNodeId;
        link["toParam"]   = toParamIndex; // index "0" for floating params

        linksArray.Add(link);
      }
    }

    // --- 5. Assemble root JSON ---
    var root = new JObject();
    root["nodes"] = nodesArray;
    root["links"] = linksArray;

    string json = root.ToString();

    // --- 6. Return JSON directly (no file I/O) ---
    A = json;
  }

  // --- helpers ---

  private static string SanitizeId(string s)
  {
    if (string.IsNullOrWhiteSpace(s))
      return "Node";

    // replace spaces and weird chars with underscores
    var chars = s.ToCharArray();
    for (int i = 0; i < chars.Length; i++)
    {
      char c = chars[i];
      if (!(char.IsLetterOrDigit(c) || c == '_' || c == '-'))
        chars[i] = '_';
    }
    return new string(chars);
  }

  private static string SafeParamName(IGH_Param p)
  {
    if (!string.IsNullOrWhiteSpace(p.NickName))
      return p.NickName;
    if (!string.IsNullOrWhiteSpace(p.Name))
      return p.Name;
    return "P";
  }

  // Match sample behaviour:
  // - Sliders (floating params) use "0" for fromParam
  // - Components use the param NickName / Name
  private static string GetFromParamName(IGH_DocumentObject owner, IGH_Param srcParam)
  {
    if (owner is GH_NumberSlider || (owner is IGH_Param && !(owner is IGH_Component)))
    {
      // single output index "0" as string
      return "0";
    }

    return SafeParamName(srcParam);
  }
}
# ---------- end c_script_2 ----------
c_script_3 = CSharpScript(x=panel_2)  # -> out, A; disabled
# ---------- c_script_3: C# ----------
// Grasshopper C# Script - .gh -> Base64
// Input:  x  (string)  -> full path to .gh file
// Output: A  (string)  -> Base64 representation of the file

using System;
using System.IO;

using Rhino;
using Rhino.Geometry;

using Grasshopper;
using Grasshopper.Kernel;
using Grasshopper.Kernel.Data;
using Grasshopper.Kernel.Types;

public class Script_Instance : GH_ScriptInstance
{
  /// <summary>
  /// This procedure contains the user code. Input parameters are provided as regular arguments,
  /// Output parameters as ref arguments.
  /// </summary>
  private void RunScript(object x, ref object A)
  {
    // --- 0. Get and validate input path ---
    string ghPath = x as string;

    if (string.IsNullOrWhiteSpace(ghPath))
    {
      A = "Please provide a .gh file path into input x.";
      return;
    }

    // Clean up quotes if the path came from a panel with quotes
    ghPath = ghPath.Trim('"');

    if (!File.Exists(ghPath))
    {
      A = $"File not found: {ghPath}";
      return;
    }

    try
    {
      // --- 1. Read file bytes ---
      byte[] fileBytes = File.ReadAllBytes(ghPath);

      // --- 2. Convert to Base64 ---
      string base64 = Convert.ToBase64String(fileBytes);

      // --- 3. Output ---
      A = base64;
    }
    catch (Exception ex)
    {
      A = $"Error reading or converting file: {ex.Message}";
    }
  }
}
# ---------- end c_script_3 ----------
c_script_4 = CSharpScript(ghPathInput=panel)  # -> out, A; disabled
# ---------- c_script_4: C# ----------
// r "C:\\Program Files\\Rhino 8\\System\\Newtonsoft.Json.dll"

using System;
using System.IO;
using System.Collections.Generic;
using System.Linq;
using Grasshopper;
using Grasshopper.Kernel;
using Grasshopper.Kernel.Parameters;
using Grasshopper.Kernel.Special;
using Newtonsoft.Json.Linq;

public class Script_Instance : GH_ScriptInstance
{
  private void RunScript(object ghPathInput, object y, ref object A)
  {
    // --- 0. Get and validate input path ---
    string ghPath = ghPathInput as string;
    if (string.IsNullOrWhiteSpace(ghPath))
    {
      A = "Please provide a .gh file path into input x.";
      return;
    }

    ghPath = ghPath.Trim('"');
    if (!File.Exists(ghPath))
    {
      A = $"File not found: {ghPath}";
      return;
    }

    // --- 1. Load GH document in memory ---
    var io = new GH_DocumentIO();
    bool ok = io.Open(ghPath);
    if (!ok || io.Document == null)
    {
      A = $"Failed to open Grasshopper file: {ghPath}";
      return;
    }

    GH_Document doc = io.Document;

    // --- 2. Collect nodes we care about (components + floating params) ---
    var orderedObjects = new List<IGH_DocumentObject>();
    var nodeIdByObject = new Dictionary<IGH_DocumentObject, string>();
    var nicknameCount = new Dictionary<string, int>();

    foreach (var obj in doc.Objects)
    {
      // Ignore groups, scribbles, etc.
      if (!(obj is IGH_Component) && !(obj is IGH_Param))
        continue;

      orderedObjects.Add(obj);

      string baseNick = !string.IsNullOrWhiteSpace(obj.NickName)
        ? obj.NickName
        : (!string.IsNullOrWhiteSpace(obj.Name) ? obj.Name : "Node");

      // sanitise a bit
      baseNick = SanitizeId(baseNick);

      int count;
      if (!nicknameCount.TryGetValue(baseNick, out count))
        count = 0;

      string id = (count == 0) ? baseNick : (baseNick + "_" + (count + 1));
      nicknameCount[baseNick] = count + 1;

      nodeIdByObject[obj] = id;
    }

    // --- 3. Build nodes array ---
    var nodesArray = new JArray();

    foreach (var obj in orderedObjects)
    {
      string id = nodeIdByObject[obj];

      var node = new JObject();
      node["id"]       = id;

      // Component / param "definition" GUID
      Guid defGuid = Guid.Empty;
      var active = obj as IGH_ActiveObject;
      if (active != null)
        defGuid = active.ComponentGuid;
      node["guid"]     = (defGuid == Guid.Empty ? obj.InstanceGuid : defGuid).ToString();

      node["nickname"] = obj.NickName;
      node["x"]        = obj.Attributes.Pivot.X;
      node["y"]        = obj.Attributes.Pivot.Y;

      // Optional properties block (e.g. sliders)
      var slider = obj as GH_NumberSlider;
      if (slider != null)
      {
        var p = new JObject();
        p["Min"]   = slider.Slider.Minimum;
        p["Max"]   = slider.Slider.Maximum;
        p["Value"] = slider.Slider.Value;
        node["properties"] = p;
      }

      // you could add more special cases (toggles, panels, etc.) here if desired

      nodesArray.Add(node);
    }

    // --- 4. Build links array ---
    var linksArray = new JArray();

    // 4a. Component inputs (component / slider / param → component)
    foreach (var obj in orderedObjects)
    {
      var comp = obj as IGH_Component;
      if (comp == null)
        continue;

      string toNodeId = nodeIdByObject[obj];

      foreach (var inputParam in comp.Params.Input)
      {
        string toParamName = SafeParamName(inputParam);

        foreach (var srcParam in inputParam.Sources)
        {
          var srcOwner = srcParam.Attributes?.DocObject as IGH_DocumentObject;
          if (srcOwner == null)
            continue;

          string fromNodeId;
          if (!nodeIdByObject.TryGetValue(srcOwner, out fromNodeId))
            continue;

          string fromParamName = GetFromParamName(srcOwner, srcParam);

          var link = new JObject();
          link["fromNode"] = fromNodeId;
          link["fromParam"] = fromParamName;
          link["toNode"] = toNodeId;
          link["toParam"] = toParamName;

          linksArray.Add(link);
        }
      }
    }

    // 4b. Floating param inputs (component / slider / param → panel / other floating param)
    foreach (var obj in orderedObjects)
    {
      var param = obj as IGH_Param;
      if (param == null)
        continue;

      // if no sources, no incoming links
      if (param.Sources.Count == 0)
        continue;

      string toNodeId = nodeIdByObject[obj];
      string toParamName = SafeParamName(param);

      foreach (var srcParam in param.Sources)
      {
        var srcOwner = srcParam.Attributes?.DocObject as IGH_DocumentObject;
        if (srcOwner == null)
          continue;

        string fromNodeId;
        if (!nodeIdByObject.TryGetValue(srcOwner, out fromNodeId))
          continue;

        string fromParamName = GetFromParamName(srcOwner, srcParam);

        var link = new JObject();
        link["fromNode"] = fromNodeId;
        link["fromParam"] = fromParamName;
        link["toNode"] = toNodeId;
        link["toParam"] = toParamName;

        linksArray.Add(link);
      }
    }

    // --- 5. Assemble root JSON ---
    var root = new JObject();
    root["nodes"] = nodesArray;
    root["links"] = linksArray;

    string json = root.ToString();

    // --- 6. Write JSON next to the .gh file ---
    string dir       = Path.GetDirectoryName(ghPath) ?? Environment.CurrentDirectory;
    string nameNoExt = Path.GetFileNameWithoutExtension(ghPath);
    string outPath   = Path.Combine(dir, nameNoExt + "_graph.json");

    Directory.CreateDirectory(dir);
    File.WriteAllText(outPath, json);

    // --- 7. Status message ---
    A = $"Parsed GH file:\n  {ghPath}\n" +
        $"nodes: {nodesArray.Count}, links: {linksArray.Count}\n" +
        $"Graph JSON written to:\n  {outPath}";
  }

  // --- helpers ---

  private static string SanitizeId(string s)
  {
    if (string.IsNullOrWhiteSpace(s))
      return "Node";

    // replace spaces and weird chars with underscores
    var chars = s.ToCharArray();
    for (int i = 0; i < chars.Length; i++)
    {
      char c = chars[i];
      if (!(char.IsLetterOrDigit(c) || c == '_' || c == '-'))
        chars[i] = '_';
    }
    return new string(chars);
  }

  private static string SafeParamName(IGH_Param p)
  {
    if (!string.IsNullOrWhiteSpace(p.NickName))
      return p.NickName;
    if (!string.IsNullOrWhiteSpace(p.Name))
      return p.Name;
    return "P";
  }

  // Match sample behaviour:
  // - Sliders (floating params) use "0" for fromParam
  // - Components use the param NickName / Name
  private static string GetFromParamName(IGH_DocumentObject owner, IGH_Param srcParam)
  {
    if (owner is GH_NumberSlider || (owner is IGH_Param && !(owner is IGH_Component)))
    {
      // single output index "0" as string
      return "0";
    }

    return SafeParamName(srcParam);
  }
}
# ---------- end c_script_4 ----------
c_script_5 = CSharpScript(ghBase64Input=get_string)  # -> out, A
# ---------- c_script_5: C# ----------
// r "C:\\Program Files\\Rhino 8\\System\\Newtonsoft.Json.dll"

using System;
using System.IO;
using System.Collections.Generic;
using System.Linq;
using Grasshopper;
using Grasshopper.Kernel;
using Grasshopper.Kernel.Parameters;
using Grasshopper.Kernel.Special;
using GH_IO.Serialization;
using Newtonsoft.Json.Linq;

public class Script_Instance : GH_ScriptInstance
{
  private void RunScript(object ghBase64Input, ref object A)
  {
    // --- 0. Get and validate Base64 input ---
    string base64 = ghBase64Input as string;
    if (string.IsNullOrWhiteSpace(base64))
    {
      A = "Please provide a Base64-encoded .gh binary into input x.";
      return;
    }

    base64 = base64.Trim('"' );

    byte[] data;
    try
    {
      data = Convert.FromBase64String(base64);
    }
    catch (Exception ex)
    {
      A = "Input is not valid Base64: " + ex.Message;
      return;
    }

    // --- 1. Load GH document from Base64 in memory ---
    var archive = new GH_Archive();
    bool ok = archive.Deserialize_Binary(data);
    if (!ok)
    {
      A = "Failed to deserialize GH binary from Base64.";
      return;
    }

    var doc = new GH_Document();
    if (!archive.ExtractObject(doc, "Definition"))
    {
      A = "Failed to extract GH document from archive (expected root 'Definition').";
      return;
    }

    // --- 2. Collect nodes we care about (components + floating params) ---
    var orderedObjects = new List<IGH_DocumentObject>();
    var nodeIdByObject = new Dictionary<IGH_DocumentObject, string>();
    var nicknameCount  = new Dictionary<string, int>();

    foreach (var obj in doc.Objects)
    {
      // Ignore groups, scribbles, etc.
      if (!(obj is IGH_Component) && !(obj is IGH_Param))
        continue;

      orderedObjects.Add(obj);

      string baseNick = !string.IsNullOrWhiteSpace(obj.NickName)
        ? obj.NickName
        : (!string.IsNullOrWhiteSpace(obj.Name) ? obj.Name : "Node");

      baseNick = SanitizeId(baseNick);

      int count;
      if (!nicknameCount.TryGetValue(baseNick, out count))
        count = 0;

      string id = (count == 0) ? baseNick : (baseNick + "_" + (count + 1));
      nicknameCount[baseNick] = count + 1;

      nodeIdByObject[obj] = id;
    }

    // --- 3. Build nodes array ---
    var nodesArray = new JArray();

    foreach (var obj in orderedObjects)
    {
      string id = nodeIdByObject[obj];

      var node = new JObject();
      node["id"] = id;

      // Component / param "definition" GUID
      Guid defGuid = Guid.Empty;
      var active = obj as IGH_ActiveObject;
      if (active != null)
        defGuid = active.ComponentGuid;

      node["guid"] = (defGuid == Guid.Empty ? obj.InstanceGuid : defGuid).ToString();
      node["nickname"] = obj.NickName;
      node["x"] = obj.Attributes.Pivot.X;
      node["y"] = obj.Attributes.Pivot.Y;

      JObject props = null;

      // Slider properties
      var slider = obj as GH_NumberSlider;
      if (slider != null)
      {
        props = props ?? new JObject();
        props["Min"]   = slider.Slider.Minimum;
        props["Max"]   = slider.Slider.Maximum;
        props["Value"] = slider.Slider.Value;
      }

      // Panel properties (text/content)
      var panel = obj as GH_Panel;
      if (panel != null)
      {
        props = props ?? new JObject();
        props["Text"] = panel.UserText;
      }

      if (props != null)
        node["properties"] = props;

      nodesArray.Add(node);
    }

    // --- 4. Build links array ---
    var linksArray = new JArray();

    // 4a. Component inputs (component / slider / param → component)
    foreach (var obj in orderedObjects)
    {
      var comp = obj as IGH_Component;
      if (comp == null)
        continue;

      string toNodeId = nodeIdByObject[obj];

      // use index instead of param name for input ports
      for (int inputIndex = 0; inputIndex < comp.Params.Input.Count; inputIndex++)
      {
        var inputParam   = comp.Params.Input[inputIndex];
        string toParamId = inputIndex.ToString();

        foreach (var srcParam in inputParam.Sources)
        {
          if (!TryResolveSource(srcParam, orderedObjects, nodeIdByObject,
                                out string fromNodeId, out string fromParamId))
            continue;

          var link = new JObject();
          link["fromNode"]  = fromNodeId;
          link["fromParam"] = fromParamId;  // "0" for floating params, index for components
          link["toNode"]    = toNodeId;
          link["toParam"]   = toParamId;    // input index

          linksArray.Add(link);
        }
      }
    }

    // 4b. Floating param inputs (component / slider / param → panel / other floating param)
    foreach (var obj in orderedObjects)
    {
      var param = obj as IGH_Param;
      if (param == null)
        continue;

      if (param.Sources.Count == 0)
        continue;

      string toNodeId  = nodeIdByObject[obj];
      string toParamId = "0"; // single implicit input index for floating params

      foreach (var srcParam in param.Sources)
      {
        if (!TryResolveSource(srcParam, orderedObjects, nodeIdByObject,
                              out string fromNodeId, out string fromParamId))
          continue;

        var link = new JObject();
        link["fromNode"]  = fromNodeId;
        link["fromParam"] = fromParamId;  // "0" or output index
        link["toNode"]    = toNodeId;
        link["toParam"]   = toParamId;    // "0" for floating param sinks

        linksArray.Add(link);
      }
    }

    // --- 5. Assemble root JSON ---
    var root = new JObject();
    root["nodes"] = nodesArray;
    root["links"] = linksArray;

    string json = root.ToString();

    // --- 6. Return JSON directly (no file I/O) ---
    A = json;
  }

  // --- helpers ---

  private static string SanitizeId(string s)
  {
    if (string.IsNullOrWhiteSpace(s))
      return "Node";

    var chars = s.ToCharArray();
    for (int i = 0; i < chars.Length; i++)
    {
      char c = chars[i];
      if (!(char.IsLetterOrDigit(c) || c == '_' || c == '-'))
        chars[i] = '_';
    }
    return new string(chars);
  }

  private static string SafeParamName(IGH_Param p)
  {
    if (!string.IsNullOrWhiteSpace(p.NickName))
      return p.NickName;
    if (!string.IsNullOrWhiteSpace(p.Name))
      return p.Name;
    return "P";
  }

  /// <summary>
  /// Resolve the source node + output param id for a given source param.
  /// - If srcParam is a floating param (slider, panel, etc.) that is a top-level doc object:
  ///     fromNodeId = that param's node id, fromParamId = "0"
  /// - If srcParam is a component output:
  ///     fromNodeId = component's node id, fromParamId = output index ("0","1",...)
  /// </summary>
  private static bool TryResolveSource(
    IGH_Param srcParam,
    List<IGH_DocumentObject> orderedObjects,
    Dictionary<IGH_DocumentObject, string> nodeIdByObject,
    out string fromNodeId,
    out string fromParamId)
  {
    fromNodeId  = null;
    fromParamId = null;

    // Case 1: srcParam itself is a top-level IGH_DocumentObject (slider, panel, floating param)
    var srcDocObj = srcParam as IGH_DocumentObject;
    if (srcDocObj != null && nodeIdByObject.TryGetValue(srcDocObj, out fromNodeId))
    {
      fromParamId = "0"; // single output index
      return true;
    }

    // Case 2: srcParam belongs to a component's Outputs
    foreach (var obj in orderedObjects)
    {
      var comp = obj as IGH_Component;
      if (comp == null)
        continue;

      int idx = comp.Params.Output.IndexOf(srcParam);
      if (idx >= 0)
      {
        fromNodeId  = nodeIdByObject[comp];
        fromParamId = idx.ToString();
        return true;
      }
    }

    // Could not resolve source node
    return false;
  }
}
# ---------- end c_script_5 ----------

# ---- group: Old - links by input name
c_script_6 = CSharpScript()  # -> out, A; disabled
# ---------- c_script_6: C# ----------
// r "C:\\Program Files\\Rhino 8\\System\\Newtonsoft.Json.dll"

using System;
using System.IO;
using System.Collections.Generic;
using System.Linq;
using Grasshopper;
using Grasshopper.Kernel;
using Grasshopper.Kernel.Parameters;
using Grasshopper.Kernel.Special;
using GH_IO.Serialization;
using Newtonsoft.Json.Linq;

public class Script_Instance : GH_ScriptInstance
{
  private void RunScript(object ghBase64Input, ref object A)
  {
    // --- 0. Get and validate Base64 input ---
    string base64 = ghBase64Input as string;
    if (string.IsNullOrWhiteSpace(base64))
    {
      A = "Please provide a Base64-encoded .gh binary into input x.";
      return;
    }

    base64 = base64.Trim('"');

    byte[] data;
    try
    {
      data = Convert.FromBase64String(base64);
    }
    catch (Exception ex)
    {
      A = "Input is not valid Base64: " + ex.Message;
      return;
    }

    // --- 1. Load GH document from Base64 in memory ---
    var archive = new GH_Archive();
    bool ok = archive.Deserialize_Binary(data);
    if (!ok)
    {
      A = "Failed to deserialize GH binary from Base64.";
      return;
    }

    var doc = new GH_Document();
    if (!archive.ExtractObject(doc, "Definition"))
    {
      A = "Failed to extract GH document from archive (expected root 'Definition').";
      return;
    }

    // --- 2. Collect nodes we care about (components + floating params) ---
    var orderedObjects   = new List<IGH_DocumentObject>();
    var nodeIdByObject   = new Dictionary<IGH_DocumentObject, string>();
    var nicknameCount    = new Dictionary<string, int>();

    foreach (var obj in doc.Objects)
    {
      // Ignore groups, scribbles, etc.
      if (!(obj is IGH_Component) && !(obj is IGH_Param))
        continue;

      orderedObjects.Add(obj);

      string baseNick = !string.IsNullOrWhiteSpace(obj.NickName)
        ? obj.NickName
        : (!string.IsNullOrWhiteSpace(obj.Name) ? obj.Name : "Node");

      // sanitise a bit
      baseNick = SanitizeId(baseNick);

      int count;
      if (!nicknameCount.TryGetValue(baseNick, out count))
        count = 0;

      string id = (count == 0) ? baseNick : (baseNick + "_" + (count + 1));
      nicknameCount[baseNick] = count + 1;

      nodeIdByObject[obj] = id;
    }

    // --- 3. Build nodes array ---
    var nodesArray = new JArray();

    foreach (var obj in orderedObjects)
    {
      string id = nodeIdByObject[obj];

      var node = new JObject();
      node["id"] = id;

      // Component / param "definition" GUID
      Guid defGuid = Guid.Empty;
      var active = obj as IGH_ActiveObject;
      if (active != null)
        defGuid = active.ComponentGuid;

      node["guid"] = (defGuid == Guid.Empty ? obj.InstanceGuid : defGuid).ToString();
      node["nickname"] = obj.NickName;
      node["x"] = obj.Attributes.Pivot.X;
      node["y"] = obj.Attributes.Pivot.Y;

      // Optional properties block (e.g. sliders)
      var slider = obj as GH_NumberSlider;
      if (slider != null)
      {
        var p = new JObject();
        p["Min"]   = slider.Slider.Minimum;
        p["Max"]   = slider.Slider.Maximum;
        p["Value"] = slider.Slider.Value;
        node["properties"] = p;
      }

      // you could add more special cases (toggles, panels, etc.) here if desired

      nodesArray.Add(node);
    }

    // --- 4. Build links array ---
    var linksArray = new JArray();

    // 4a. Component inputs (component / slider / param → component)
    foreach (var obj in orderedObjects)
    {
      var comp = obj as IGH_Component;
      if (comp == null)
        continue;

      string toNodeId = nodeIdByObject[obj];

      foreach (var inputParam in comp.Params.Input)
      {
        string toParamName = SafeParamName(inputParam);

        foreach (var srcParam in inputParam.Sources)
        {
          var srcOwner = srcParam.Attributes?.DocObject as IGH_DocumentObject;
          if (srcOwner == null)
            continue;

          string fromNodeId;
          if (!nodeIdByObject.TryGetValue(srcOwner, out fromNodeId))
            continue;

          string fromParamName = GetFromParamName(srcOwner, srcParam);

          var link = new JObject();
          link["fromNode"]  = fromNodeId;
          link["fromParam"] = fromParamName;
          link["toNode"]    = toNodeId;
          link["toParam"]   = toParamName;

          linksArray.Add(link);
        }
      }
    }

    // 4b. Floating param inputs (component / slider / param → panel / other floating param)
    foreach (var obj in orderedObjects)
    {
      var param = obj as IGH_Param;
      if (param == null)
        continue;

      // if no sources, no incoming links
      if (param.Sources.Count == 0)
        continue;

      string toNodeId = nodeIdByObject[obj];
      string toParamName = SafeParamName(param);

      foreach (var srcParam in param.Sources)
      {
        var srcOwner = srcParam.Attributes?.DocObject as IGH_DocumentObject;
        if (srcOwner == null)
          continue;

        string fromNodeId;
        if (!nodeIdByObject.TryGetValue(srcOwner, out fromNodeId))
          continue;

        string fromParamName = GetFromParamName(srcOwner, srcParam);

        var link = new JObject();
        link["fromNode"]  = fromNodeId;
        link["fromParam"] = fromParamName;
        link["toNode"]    = toNodeId;
        link["toParam"]   = toParamName;

        linksArray.Add(link);
      }
    }

    // --- 5. Assemble root JSON ---
    var root = new JObject();
    root["nodes"] = nodesArray;
    root["links"] = linksArray;

    string json = root.ToString();

    // --- 6. Return JSON directly (no file I/O) ---
    A = json;
  }

  // --- helpers ---

  private static string SanitizeId(string s)
  {
    if (string.IsNullOrWhiteSpace(s))
      return "Node";

    // replace spaces and weird chars with underscores
    var chars = s.ToCharArray();
    for (int i = 0; i < chars.Length; i++)
    {
      char c = chars[i];
      if (!(char.IsLetterOrDigit(c) || c == '_' || c == '-'))
        chars[i] = '_';
    }
    return new string(chars);
  }

  private static string SafeParamName(IGH_Param p)
  {
    if (!string.IsNullOrWhiteSpace(p.NickName))
      return p.NickName;
    if (!string.IsNullOrWhiteSpace(p.Name))
      return p.Name;
    return "P";
  }

  // Match sample behaviour:
  // - Sliders (floating params) use "0" for fromParam
  // - Components use the param NickName / Name
  private static string GetFromParamName(IGH_DocumentObject owner, IGH_Param srcParam)
  {
    if (owner is GH_NumberSlider || (owner is IGH_Param && !(owner is IGH_Component)))
    {
      // single output index "0" as string
      return "0";
    }

    return SafeParamName(srcParam);
  }
}
# ---------- end c_script_6 ----------

# ----
panel_3 = Panel(c_script_4.A)  # disabled
context_print = ContextPrint(Validation_msg="this script opened and ran")
json_script = ContextPrint(Gh_json=c_script_5.A)
