# Grasshopper definition compute-json-to-gh.gh (Grasshopper 1.0.8)
# plug-ins: RhinoCodePluginGH

example = Panel("""{
  "nodes": [
    {
      "id": "slider_x",
      "guid": "57da07bd-ecab-415d-9d86-af36d7073abc",
      "nickname": "X",
      "x": 40,
      "y": 40,
      "properties": { "Min": -10.0, "Max": 10.0, "Value": 2.0 }
    },
    {
      "id": "slider_y",
      "guid": "57da07bd-ecab-415d-9d86-af36d7073abc",
      "nickname": "Y",
      "x": 40,
      "y": 100,
      "properties": { "Min": -10.0, "Max": 10.0, "Value": 1.0 }
    },
    {
      "id": "slider_z",
      "guid": "57da07bd-ecab-415d-9d86-af36d7073abc",
      "nickname": "Z",
      "x": 40,
      "y": 160,
      "properties": { "Min": -10.0, "Max": 10.0, "Value": 0.0 }
    },
    {
      "id": "slider_r",
      "guid": "57da07bd-ecab-415d-9d86-af36d7073abc",
      "nickname": "R",
      "x": 40,
      "y": 220,
      "properties": { "Min": 0.1, "Max": 10.0, "Value": 3.0 }
    },
    {
      "id": "pt",
      "guid": "3581f42a-9592-4549-bd6b-1c0fc39d067b",
      "nickname": "Pt",
      "x": 260,
      "y": 100
    },
    {
      "id": "box",
      "guid": "28061aae-04fb-4cb5-ac45-16f3b66bc0a4",
      "nickname": "Box",
      "x": 460,
      "y": 60
    },
    {
      "id": "sphere",
      "guid": "dabc854d-f50e-408a-b001-d043c7de151d",
      "nickname": "Sph",
      "x": 460,
      "y": 180
    },
    {
      "id": "sdiff",
      "guid": "fab11c30-2d9c-4d15-ab3c-2289f1ae5c21",
      "nickname": "SDiff",
      "x": 680,
      "y": 120
    }
  ],
  "links": [
    { "fromNode": "slider_x", "fromParam": "0",  "toNode": "pt",     "toParam": "X" },
    { "fromNode": "slider_y", "fromParam": "0",  "toNode": "pt",     "toParam": "Y" },
    { "fromNode": "slider_z", "fromParam": "0",  "toNode": "pt",     "toParam": "Z" },

    { "fromNode": "pt",       "fromParam": "Pt", "toNode": "sphere", "toParam": "B" },
    { "fromNode": "slider_r", "fromParam": "0",  "toNode": "sphere", "toParam": "R" },

    { "fromNode": "pt",       "fromParam": "Pt", "toNode": "box",    "toParam": "B" },
    { "fromNode": "slider_r", "fromParam": "0",  "toNode": "box",    "toParam": "X" },
    { "fromNode": "slider_r", "fromParam": "0",  "toNode": "box",    "toParam": "Y" },
    { "fromNode": "slider_r", "fromParam": "0",  "toNode": "box",    "toParam": "Z" },

    { "fromNode": "sphere",   "fromParam": "S",  "toNode": "sdiff",  "toParam": "A" },
    { "fromNode": "box",      "fromParam": "B",  "toNode": "sdiff",  "toParam": "B" }
  ]
}""")  # disabled
get_string = GetString(AtLeast=1, AtMost=1, TreeAccess=False)
c_script = CSharpScript()  # -> out, a; inputs x: String; disabled
# ---------- c_script: C# ----------
#r "C:\Program Files\Rhino 8\System\Newtonsoft.Json.dll"
#r "C:\Program Files\Rhino 8\Plug-ins\Grasshopper\GH_IO.dll"

// Grasshopper Script Instance
#region Usings
using System;
using System.IO;
using System.Linq;
using System.Collections;
using System.Collections.Generic;
using System.Drawing;
using System.Globalization;

using Rhino;
using Rhino.Geometry;

using Grasshopper;
using Grasshopper.Kernel;
using Grasshopper.Kernel.Data;
using Grasshopper.Kernel.Types;
using Grasshopper.Kernel.Special;

using GH_IO.Serialization;

using Newtonsoft.Json;
#endregion

public class Script_Instance : GH_ScriptInstance
{
    #region Notes
    /* 
      Members:
        RhinoDoc RhinoDocument
        GH_Document GrasshopperDocument
        IGH_Component Component
        int Iteration

      Methods (Virtual & overridable):
        Print(string text)
        Print(string format, params object[] args)
        Reflect(object obj)
        Reflect(object obj, string method_name)
    */
    #endregion

    // Input x: Type Hint = string (JSON file path)
    private void RunScript(string x, ref object a)
    {
        if (string.IsNullOrWhiteSpace(x))
        {
            a = "No JSON path provided.";
            return;
        }

        var jsonPath = x;
        if (!File.Exists(jsonPath))
        {
            a = "JSON file not found: " + jsonPath;
            return;
        }

        // Output GH (binary) next to JSON
        var ghPath = Path.ChangeExtension(jsonPath, ".gh");

        try
        {
            GhGenerator.Generate(jsonPath, ghPath);
            a = "Generated GH: " + ghPath;
        }
        catch (Exception ex)
        {
            a = "Error:\n" + ex;
        }
    }

    #region Additional

    // ---------- JSON models ----------

    public class GhDefinitionJson
    {
        public List<NodeJson> nodes { get; set; }
        public List<LinkJson> links { get; set; }
    }

    public class NodeJson
    {
        public string id { get; set; }

        // Preferred: GH component/param GUID, e.g. "28061aae-04fb-4cb5-ac45-16f3b66bc0a4"
        public string guid { get; set; }

        // Optional fallback: .NET type name (assembly-qualified or resolvable by Type.GetType)
        public string type { get; set; }

        public string nickname { get; set; }
        public float x { get; set; }
        public float y { get; set; }
        public Dictionary<string, object> properties { get; set; }
    }

    public class LinkJson
    {
        public string fromNode { get; set; }
        public string fromParam { get; set; }      // output param nickname or index as string
        public string toNode { get; set; }
        public string toParam { get; set; }        // input param nickname or index as string
    }

    // ---------- Generator core ----------

    public static class GhGenerator
    {
        public static void Generate(string jsonPath, string ghOutputPath)
        {
            string json = File.ReadAllText(jsonPath);
            var def = JsonConvert.DeserializeObject<GhDefinitionJson>(json);
            if (def == null)
                throw new Exception("Failed to deserialize JSON.");

            var doc = new GH_Document();
            var nodeMap = new Dictionary<string, IGH_DocumentObject>();

            // 1. Create nodes
            foreach (var node in def.nodes ?? new List<NodeJson>())
            {
                var obj = CreateObjectFromNode(node);
                if (obj == null)
                    continue;

                // UI attributes & position
                obj.CreateAttributes();
                obj.Attributes.Pivot = new PointF(node.x, node.y);

                if (!string.IsNullOrEmpty(node.nickname))
                {
                    obj.NickName = node.nickname;
                    obj.Name = node.nickname;
                }

                doc.AddObject(obj, false);
                ApplyNodeProperties(obj, node.properties);

                nodeMap[node.id] = obj;
            }

            // 2. Create links (wires)
            foreach (var link in def.links ?? new List<LinkJson>())
            {
                if (!nodeMap.TryGetValue(link.fromNode, out var fromObj))
                    continue;
                if (!nodeMap.TryGetValue(link.toNode, out var toObj))
                    continue;

                var fromParam = ResolveOutputParam(fromObj, link.fromParam);
                var toParam   = ResolveInputParam(toObj, link.toParam);

                if (fromParam == null || toParam == null)
                    continue;

                // Connect source to target input
                toParam.AddSource(fromParam);
            }

            // 3. Serialize to binary GH
            var archive = new GH_Archive();
            archive.AppendObject(doc, "Definition");
            archive.WriteToFile(ghOutputPath, true, false); // binary = true, rememberPath = false
        }

        // ---------- Helpers ----------

        private static IGH_DocumentObject CreateObjectFromNode(NodeJson node)
        {
            if (node == null)
                return null;

            // 1) Preferred: instantiate by GH object GUID via ComponentServer
            if (!string.IsNullOrEmpty(node.guid))
            {
                if (Guid.TryParse(node.guid, out var g))
                {
                    var objFromGuid = Instances.ComponentServer.EmitObject(g);
                    if (objFromGuid != null)
                        return objFromGuid;

                    Rhino.RhinoApp.WriteLine("Could not instantiate object for GUID: " + node.guid);
                }
                else
                {
                    Rhino.RhinoApp.WriteLine("Invalid GUID string: " + node.guid);
                }
            }

            // 2) Fallback: instantiate by .NET type if provided
            if (!string.IsNullOrEmpty(node.type))
            {
                var t = Type.GetType(node.type, false);
                if (t == null)
                {
                    Rhino.RhinoApp.WriteLine("Could not resolve type: " + node.type);
                    return null;
                }

                try
                {
                    var instance = Activator.CreateInstance(t) as IGH_DocumentObject;
                    if (instance == null)
                        Rhino.RhinoApp.WriteLine("Type is not IGH_DocumentObject: " + node.type);

                    return instance;
                }
                catch (Exception ex)
                {
                    Rhino.RhinoApp.WriteLine("Error creating type " + node.type + ": " + ex.Message);
                    return null;
                }
            }

            Rhino.RhinoApp.WriteLine("Node has neither valid guid nor type: " + (node.id ?? "<no id>"));
            return null;
        }

        private static void ApplyNodeProperties(IGH_DocumentObject obj, Dictionary<string, object> props)
        {
            if (obj == null || props == null || props.Count == 0)
                return;

            // Number slider example
            if (obj is GH_NumberSlider slider)
            {
                if (props.TryGetValue("Min", out var minObj) && TryGetDecimal(minObj, out var min))
                    slider.Slider.Minimum = min;

                if (props.TryGetValue("Max", out var maxObj) && TryGetDecimal(maxObj, out var max))
                    slider.Slider.Maximum = max;

                if (props.TryGetValue("Value", out var valObj) && TryGetDecimal(valObj, out var val))
                    slider.Slider.Value = val;
            }

            // Panel example
            if (obj is GH_Panel panel)
            {
                if (props.TryGetValue("Text", out var textObj))
                    panel.UserText = textObj.ToString();
            }

            // Extend with more component-specific cases as needed.
        }

        private static bool TryGetDecimal(object input, out decimal result)
        {
            if (input == null)
            {
                result = 0m;
                return false;
            }

            // Already decimal
            if (input is decimal d)
            {
                result = d;
                return true;
            }

            // Common numeric types
            if (input is double dbl)
            {
                result = (decimal)dbl;
                return true;
            }

            if (input is float fl)
            {
                result = (decimal)fl;
                return true;
            }

            if (input is int i)
            {
                result = i;
                return true;
            }

            if (input is long l)
            {
                result = l;
                return true;
            }

            // Fallback: parse string
            return decimal.TryParse(
                input.ToString(),
                NumberStyles.Any,
                CultureInfo.InvariantCulture,
                out result
            );
        }

        // Output param: components or single-parameter objects (sliders, panels)
        private static IGH_Param ResolveOutputParam(IGH_DocumentObject obj, string key)
        {
            if (obj is IGH_Param pParam)
                return pParam;

            if (obj is IGH_Component comp)
                return FindOutputParam(comp, key);

            return null;
        }

        // Input param: components or single-parameter objects (panels, value params)
        private static IGH_Param ResolveInputParam(IGH_DocumentObject obj, string key)
        {
            if (obj is IGH_Param pParam)
                return pParam;

            if (obj is IGH_Component comp)
                return FindInputParam(comp, key);

            return null;
        }

        private static IGH_Param FindOutputParam(IGH_Component comp, string key)
        {
            if (comp == null || comp.Params.Output.Count == 0)
                return null;

            if (int.TryParse(key, out int index))
            {
                if (index >= 0 && index < comp.Params.Output.Count)
                    return comp.Params.Output[index];
            }

            return comp.Params.Output.FirstOrDefault(p =>
                string.Equals(p.NickName, key, StringComparison.OrdinalIgnoreCase) ||
                string.Equals(p.Name, key, StringComparison.OrdinalIgnoreCase));
        }

        private static IGH_Param FindInputParam(IGH_Component comp, string key)
        {
            if (comp == null || comp.Params.Input.Count == 0)
                return null;

            if (int.TryParse(key, out int index))
            {
                if (index >= 0 && index < comp.Params.Input.Count)
                    return comp.Params.Input[index];
            }

            return comp.Params.Input.FirstOrDefault(p =>
                string.Equals(p.NickName, key, StringComparison.OrdinalIgnoreCase) ||
                string.Equals(p.Name, key, StringComparison.OrdinalIgnoreCase));
        }
    }

    #endregion
}
# ---------- end c_script ----------
c_script_2 = CSharpScript()  # -> out, a; inputs x: String; disabled
# ---------- c_script_2: C# ----------
#r "C:\Program Files\Rhino 8\System\Newtonsoft.Json.dll"
#r "C:\Program Files\Rhino 8\Plug-ins\Grasshopper\GH_IO.dll"

// Grasshopper Script Instance
#region Usings
using System;
using System.IO;
using System.Linq;
using System.Collections;
using System.Collections.Generic;
using System.Drawing;
using System.Globalization;

using Rhino;
using Rhino.Geometry;

using Grasshopper;
using Grasshopper.Kernel;
using Grasshopper.Kernel.Data;
using Grasshopper.Kernel.Types;
using Grasshopper.Kernel.Special;

using GH_IO.Serialization;

using Newtonsoft.Json;
#endregion

public class Script_Instance : GH_ScriptInstance
{
    #region Notes
    /* 
      Members:
        RhinoDoc RhinoDocument
        GH_Document GrasshopperDocument
        IGH_Component Component
        int Iteration

      Methods (Virtual & overridable):
        Print(string text)
        Print(string format, params object[] args)
        Reflect(object obj)
        Reflect(object obj, string method_name)
    */
    #endregion

    // Input x: Type Hint = string (JSON definition)
    // Output a: Base64 string of the generated .gh file (binary)
    private void RunScript(string x, ref object a)
    {
        if (string.IsNullOrWhiteSpace(x))
        {
            a = "No JSON string provided.";
            return;
        }

        try
        {
            // Generate base64-encoded GH binary from JSON definition string
            string base64Gh = GhGenerator.GenerateBase64FromJson(x);
            a = base64Gh;
        }
        catch (Exception ex)
        {
            a = "Error:\n" + ex;
        }
    }

    #region Additional

    // ---------- JSON models ----------

    public class GhDefinitionJson
    {
        public List<NodeJson> nodes { get; set; }
        public List<LinkJson> links { get; set; }
    }

    public class NodeJson
    {
        public string id { get; set; }

        // Preferred: GH component/param GUID, e.g. "28061aae-04fb-4cb5-ac45-16f3b66bc0a4"
        public string guid { get; set; }

        // Optional fallback: .NET type name (assembly-qualified or resolvable by Type.GetType)
        public string type { get; set; }

        public string nickname { get; set; }
        public float x { get; set; }
        public float y { get; set; }
        public Dictionary<string, object> properties { get; set; }
    }

    public class LinkJson
    {
        public string fromNode { get; set; }
        public string fromParam { get; set; }      // output param nickname or index as string
        public string toNode { get; set; }
        public string toParam { get; set; }        // input param nickname or index as string
    }

    // ---------- Generator core ----------

    public static class GhGenerator
    {
        /// <summary>
        /// Takes a JSON string definition and returns a Base64-encoded binary .gh file.
        /// </summary>
        public static string GenerateBase64FromJson(string json)
        {
            var def = JsonConvert.DeserializeObject<GhDefinitionJson>(json);
            if (def == null)
                throw new Exception("Failed to deserialize JSON.");

            var doc = new GH_Document();
            var nodeMap = new Dictionary<string, IGH_DocumentObject>();

            // 1. Create nodes
            foreach (var node in def.nodes ?? new List<NodeJson>())
            {
                var obj = CreateObjectFromNode(node);
                if (obj == null)
                    continue;

                // UI attributes & position
                obj.CreateAttributes();
                obj.Attributes.Pivot = new PointF(node.x, node.y);

                if (!string.IsNullOrEmpty(node.nickname))
                {
                    obj.NickName = node.nickname;
                    obj.Name = node.nickname;
                }

                doc.AddObject(obj, false);
                ApplyNodeProperties(obj, node.properties);

                nodeMap[node.id] = obj;
            }

            // 2. Create links (wires)
            foreach (var link in def.links ?? new List<LinkJson>())
            {
                if (!nodeMap.TryGetValue(link.fromNode, out var fromObj))
                    continue;
                if (!nodeMap.TryGetValue(link.toNode, out var toObj))
                    continue;

                var fromParam = ResolveOutputParam(fromObj, link.fromParam);
                var toParam   = ResolveInputParam(toObj, link.toParam);

                if (fromParam == null || toParam == null)
                    continue;

                // Connect source to target input
                toParam.AddSource(fromParam);
            }

            // 3. Serialize to binary GH in memory and encode as Base64
            var archive = new GH_Archive();
            archive.AppendObject(doc, "Definition");

            // Get binary .gh bytes
            byte[] ghBytes = archive.Serialize_Binary();
            if (ghBytes == null || ghBytes.Length == 0)
                throw new Exception("Failed to serialize GH document to binary.");

            // Convert to Base64
            return Convert.ToBase64String(ghBytes);
        }

        // ---------- Helpers ----------

        private static IGH_DocumentObject CreateObjectFromNode(NodeJson node)
        {
            if (node == null)
                return null;

            // 1) Preferred: instantiate by GH object GUID via ComponentServer
            if (!string.IsNullOrEmpty(node.guid))
            {
                if (Guid.TryParse(node.guid, out var g))
                {
                    var objFromGuid = Instances.ComponentServer.EmitObject(g);
                    if (objFromGuid != null)
                        return objFromGuid;

                    Rhino.RhinoApp.WriteLine("Could not instantiate object for GUID: " + node.guid);
                }
                else
                {
                    Rhino.RhinoApp.WriteLine("Invalid GUID string: " + node.guid);
                }
            }

            // 2) Fallback: instantiate by .NET type if provided
            if (!string.IsNullOrEmpty(node.type))
            {
                var t = Type.GetType(node.type, false);
                if (t == null)
                {
                    Rhino.RhinoApp.WriteLine("Could not resolve type: " + node.type);
                    return null;
                }

                try
                {
                    var instance = Activator.CreateInstance(t) as IGH_DocumentObject;
                    if (instance == null)
                        Rhino.RhinoApp.WriteLine("Type is not IGH_DocumentObject: " + node.type);

                    return instance;
                }
                catch (Exception ex)
                {
                    Rhino.RhinoApp.WriteLine("Error creating type " + node.type + ": " + ex.Message);
                    return null;
                }
            }

            Rhino.RhinoApp.WriteLine("Node has neither valid guid nor type: " + (node.id ?? "<no id>"));
            return null;
        }

        private static void ApplyNodeProperties(IGH_DocumentObject obj, Dictionary<string, object> props)
        {
            if (obj == null || props == null || props.Count == 0)
                return;

            // Number slider example
            if (obj is GH_NumberSlider slider)
            {
                if (props.TryGetValue("Min", out var minObj) && TryGetDecimal(minObj, out var min))
                    slider.Slider.Minimum = min;

                if (props.TryGetValue("Max", out var maxObj) && TryGetDecimal(maxObj, out var max))
                    slider.Slider.Maximum = max;

                if (props.TryGetValue("Value", out var valObj) && TryGetDecimal(valObj, out var val))
                    slider.Slider.Value = val;
            }

            // Panel example
            if (obj is GH_Panel panel)
            {
                if (props.TryGetValue("Text", out var textObj))
                    panel.UserText = textObj.ToString();
            }

            // Extend with more component-specific cases as needed.
        }

        private static bool TryGetDecimal(object input, out decimal result)
        {
            if (input == null)
            {
                result = 0m;
                return false;
            }

            // Already decimal
            if (input is decimal d)
            {
                result = d;
                return true;
            }

            // Common numeric types
            if (input is double dbl)
            {
                result = (decimal)dbl;
                return true;
            }

            if (input is float fl)
            {
                result = (decimal)fl;
                return true;
            }

            if (input is int i)
            {
                result = i;
                return true;
            }

            if (input is long l)
            {
                result = l;
                return true;
            }

            // Fallback: parse string
            return decimal.TryParse(
                input.ToString(),
                NumberStyles.Any,
                CultureInfo.InvariantCulture,
                out result
            );
        }

        // Output param: components or single-parameter objects (sliders, panels)
        private static IGH_Param ResolveOutputParam(IGH_DocumentObject obj, string key)
        {
            if (obj is IGH_Param pParam)
                return pParam;

            if (obj is IGH_Component comp)
                return FindOutputParam(comp, key);

            return null;
        }

        // Input param: components or single-parameter objects (panels, value params)
        private static IGH_Param ResolveInputParam(IGH_DocumentObject obj, string key)
        {
            if (obj is IGH_Param pParam)
                return pParam;

            if (obj is IGH_Component comp)
                return FindInputParam(comp, key);

            return null;
        }

        private static IGH_Param FindOutputParam(IGH_Component comp, string key)
        {
            if (comp == null || comp.Params.Output.Count == 0)
                return null;

            if (int.TryParse(key, out int index))
            {
                if (index >= 0 && index < comp.Params.Output.Count)
                    return comp.Params.Output[index];
            }

            return comp.Params.Output.FirstOrDefault(p =>
                string.Equals(p.NickName, key, StringComparison.OrdinalIgnoreCase) ||
                string.Equals(p.Name, key, StringComparison.OrdinalIgnoreCase));
        }

        private static IGH_Param FindInputParam(IGH_Component comp, string key)
        {
            if (comp == null || comp.Params.Input.Count == 0)
                return null;

            if (int.TryParse(key, out int index))
            {
                if (index >= 0 && index < comp.Params.Input.Count)
                    return comp.Params.Input[index];
            }

            return comp.Params.Input.FirstOrDefault(p =>
                string.Equals(p.NickName, key, StringComparison.OrdinalIgnoreCase) ||
                string.Equals(p.Name, key, StringComparison.OrdinalIgnoreCase));
        }
    }

    #endregion
}
# ---------- end c_script_2 ----------
c_script_3 = CSharpScript(x=example)  # -> out, a, b, c; inputs x: String; disabled
# ---------- c_script_3: C# ----------
#r "C:\Program Files\Rhino 8\System\Newtonsoft.Json.dll"
#r "C:\Program Files\Rhino 8\Plug-ins\Grasshopper\GH_IO.dll"

// Grasshopper Script Instance
#region Usings
using System;
using System.IO;
using System.Linq;
using System.Collections;
using System.Collections.Generic;
using System.Drawing;
using System.Globalization;

using Rhino;
using Rhino.Geometry;

using Grasshopper;
using Grasshopper.Kernel;
using Grasshopper.Kernel.Data;
using Grasshopper.Kernel.Types;
using Grasshopper.Kernel.Special;

using GH_IO.Serialization;

using Newtonsoft.Json;
#endregion

public class Script_Instance : GH_ScriptInstance
{
    #region Notes
    /* 
      Members:
        RhinoDoc RhinoDocument
        GH_Document GrasshopperDocument
        IGH_Component Component
        int Iteration

      Methods (Virtual & overridable):
        Print(string text)
        Print(string format, params object[] args)
        Reflect(object obj)
        Reflect(object obj, string method_name)
    */
    #endregion

    // Inputs:
    //   x: string (JSON definition)
    //
    // Outputs:
    //   a: Base64 string of the generated .gh file (binary)
    //   b: Debug log messages (list of strings)
    //   c: Summary string (node/link counts, failed links)
    private void RunScript(string x, ref object a, ref object b, ref object c)
    {
        if (string.IsNullOrWhiteSpace(x))
        {
            a = "No JSON string provided.";
            b = null;
            c = null;
            return;
        }

        var logs = new List<string>();

        try
        {
            int nodeCount, linkCount, failedLinks;
            string base64Gh = GhGenerator.GenerateBase64FromJson(
                x,
                msg =>
                {
                    logs.Add(msg);
                    Rhino.RhinoApp.WriteLine(msg);
                },
                out nodeCount,
                out linkCount,
                out failedLinks
            );

            a = base64Gh;
            b = logs;
            c = $"Nodes: {nodeCount}, Links: {linkCount}, FailedLinks: {failedLinks}";
        }
        catch (Exception ex)
        {
            a = "Error:\n" + ex;
            b = logs;
            c = "Error encountered while generating GH document.";
        }
    }

    #region Additional

    // ---------- JSON models ----------

    public class GhDefinitionJson
    {
        public List<NodeJson> nodes { get; set; }
        public List<LinkJson> links { get; set; }
    }

    public class NodeJson
    {
        public string id { get; set; }

        // Preferred: GH component/param GUID, e.g. "28061aae-04fb-4cb5-ac45-16f3b66bc0a4"
        public string guid { get; set; }

        // Optional fallback: .NET type name (assembly-qualified or resolvable by Type.GetType)
        public string type { get; set; }

        public string nickname { get; set; }
        public float x { get; set; }
        public float y { get; set; }
        public Dictionary<string, object> properties { get; set; }
    }

    public class LinkJson
    {
        public string fromNode { get; set; }
        public string fromParam { get; set; }      // output param nickname or index as string
        public string toNode { get; set; }
        public string toParam { get; set; }        // input param nickname or index as string
    }

    // ---------- Generator core ----------

    public static class GhGenerator
    {
        /// <summary>
        /// Takes a JSON string definition and returns a Base64-encoded binary .gh file.
        /// Also returns node/link counts and number of failed links.
        /// </summary>
        public static string GenerateBase64FromJson(
            string json,
            Action<string> log,
            out int nodeCount,
            out int linkCount,
            out int failedLinks
        )
        {
            nodeCount   = 0;
            linkCount   = 0;
            failedLinks = 0;

            var def = JsonConvert.DeserializeObject<GhDefinitionJson>(json);
            if (def == null)
                throw new Exception("Failed to deserialize JSON.");

            var doc = new GH_Document();
            var nodeMap = new Dictionary<string, IGH_DocumentObject>();

            // 1. Create nodes
            foreach (var node in def.nodes ?? new List<NodeJson>())
            {
                var obj = CreateObjectFromNode(node, log);
                if (obj == null)
                {
                    log?.Invoke($"[GHGen] Skipping node '{node.id}' (could not create object).");
                    continue;
                }

                // UI attributes & position
                obj.CreateAttributes();
                obj.Attributes.Pivot = new PointF(node.x, node.y);

                if (!string.IsNullOrEmpty(node.nickname))
                {
                    obj.NickName = node.nickname;
                    obj.Name = node.nickname;
                }

                doc.AddObject(obj, false);
                ApplyNodeProperties(obj, node.properties, log);

                nodeMap[node.id] = obj;
                nodeCount++;
            }

            // 2. Create links (wires)
            foreach (var link in def.links ?? new List<LinkJson>())
            {
                linkCount++;

                if (!nodeMap.TryGetValue(link.fromNode, out var fromObj))
                {
                    log?.Invoke($"[GHGen] Link skipped: fromNode '{link.fromNode}' not found.");
                    failedLinks++;
                    continue;
                }

                if (!nodeMap.TryGetValue(link.toNode, out var toObj))
                {
                    log?.Invoke($"[GHGen] Link skipped: toNode '{link.toNode}' not found.");
                    failedLinks++;
                    continue;
                }

                var fromParam = ResolveOutputParam(fromObj, link.fromParam);
                if (fromParam == null)
                {
                    log?.Invoke(
                        $"[GHGen] Link skipped: fromParam '{link.fromParam}' not resolved on node '{link.fromNode}'.");
                    failedLinks++;
                    continue;
                }

                var toParam = ResolveInputParam(toObj, link.toParam);
                if (toParam == null)
                {
                    log?.Invoke(
                        $"[GHGen] Link skipped: toParam '{link.toParam}' not resolved on node '{link.toNode}'.");
                    failedLinks++;
                    continue;
                }

                // Connect source to target input
                toParam.AddSource(fromParam);
            }

            // 3. Serialize to binary GH in memory and encode as Base64
            var archive = new GH_Archive();
            archive.AppendObject(doc, "Definition");

            byte[] ghBytes = archive.Serialize_Binary();
            if (ghBytes == null || ghBytes.Length == 0)
                throw new Exception("Failed to serialize GH document to binary.");

            return Convert.ToBase64String(ghBytes);
        }

        // ---------- Helpers ----------

        private static IGH_DocumentObject CreateObjectFromNode(NodeJson node, Action<string> log)
        {
            if (node == null)
                return null;

            // 1) Preferred: instantiate by GH object GUID via ComponentServer
            if (!string.IsNullOrEmpty(node.guid))
            {
                if (Guid.TryParse(node.guid, out var g))
                {
                    var objFromGuid = Instances.ComponentServer.EmitObject(g);
                    if (objFromGuid != null)
                        return objFromGuid;

                    log?.Invoke("[GHGen] Could not instantiate object for GUID: " + node.guid);
                }
                else
                {
                    log?.Invoke("[GHGen] Invalid GUID string: " + node.guid);
                }
            }

            // 2) Fallback: instantiate by .NET type if provided
            if (!string.IsNullOrEmpty(node.type))
            {
                var t = Type.GetType(node.type, false);
                if (t == null)
                {
                    log?.Invoke("[GHGen] Could not resolve type: " + node.type);
                    return null;
                }

                try
                {
                    var instance = Activator.CreateInstance(t) as IGH_DocumentObject;
                    if (instance == null)
                        log?.Invoke("[GHGen] Type is not IGH_DocumentObject: " + node.type);

                    return instance;
                }
                catch (Exception ex)
                {
                    log?.Invoke("[GHGen] Error creating type " + node.type + ": " + ex.Message);
                    return null;
                }
            }

            log?.Invoke("[GHGen] Node has neither valid guid nor type: " + (node.id ?? "<no id>"));
            return null;
        }

        private static void ApplyNodeProperties(IGH_DocumentObject obj, Dictionary<string, object> props, Action<string> log)
        {
            if (obj == null || props == null || props.Count == 0)
                return;

            // Number slider example
            if (obj is GH_NumberSlider slider)
            {
                if (props.TryGetValue("Min", out var minObj) && TryGetDecimal(minObj, out var min))
                    slider.Slider.Minimum = min;

                if (props.TryGetValue("Max", out var maxObj) && TryGetDecimal(maxObj, out var max))
                    slider.Slider.Maximum = max;

                if (props.TryGetValue("Value", out var valObj) && TryGetDecimal(valObj, out var val))
                    slider.Slider.Value = val;
            }

            // Panel example
            if (obj is GH_Panel panel)
            {
                if (props.TryGetValue("Text", out var textObj))
                    panel.UserText = textObj.ToString();
            }

            // Extend with more component-specific cases as needed.
        }

        private static bool TryGetDecimal(object input, out decimal result)
        {
            if (input == null)
            {
                result = 0m;
                return false;
            }

            if (input is decimal d)
            {
                result = d;
                return true;
            }

            if (input is double dbl)
            {
                result = (decimal)dbl;
                return true;
            }

            if (input is float fl)
            {
                result = (decimal)fl;
                return true;
            }

            if (input is int i)
            {
                result = i;
                return true;
            }

            if (input is long l)
            {
                result = l;
                return true;
            }

            return decimal.TryParse(
                input.ToString(),
                NumberStyles.Any,
                CultureInfo.InvariantCulture,
                out result
            );
        }

        // Output param: components or single-parameter objects (sliders, panels)
        private static IGH_Param ResolveOutputParam(IGH_DocumentObject obj, string key)
        {
            // Floating param as owner → just return that param
            if (obj is IGH_Param pParam)
                return pParam;

            if (obj is IGH_Component comp)
                return FindOutputParam(comp, key);

            return null;
        }

        // Input param: components or single-parameter objects (panels, value params)
        private static IGH_Param ResolveInputParam(IGH_DocumentObject obj, string key)
        {
            // Floating param as sink → just return that param (ignores key)
            if (obj is IGH_Param pParam)
                return pParam;

            if (obj is IGH_Component comp)
                return FindInputParam(comp, key);

            return null;
        }

        private static IGH_Param FindOutputParam(IGH_Component comp, string key)
        {
            if (comp == null || comp.Params.Output.Count == 0)
                return null;

            // index-based lookup first
            if (int.TryParse(key, out int index))
            {
                if (index >= 0 && index < comp.Params.Output.Count)
                    return comp.Params.Output[index];
            }

            // fallback: nickname / name
            return comp.Params.Output.FirstOrDefault(p =>
                string.Equals(p.NickName, key, StringComparison.OrdinalIgnoreCase) ||
                string.Equals(p.Name, key, StringComparison.OrdinalIgnoreCase));
        }

        private static IGH_Param FindInputParam(IGH_Component comp, string key)
        {
            if (comp == null || comp.Params.Input.Count == 0)
                return null;

            // index-based lookup first
            if (int.TryParse(key, out int index))
            {
                if (index >= 0 && index < comp.Params.Input.Count)
                    return comp.Params.Input[index];
            }

            // fallback: nickname / name
            return comp.Params.Input.FirstOrDefault(p =>
                string.Equals(p.NickName, key, StringComparison.OrdinalIgnoreCase) ||
                string.Equals(p.Name, key, StringComparison.OrdinalIgnoreCase));
        }
    }

    #endregion
}
# ---------- end c_script_3 ----------
panel = Panel(c_script.a)
c_script_4 = CSharpScript(x=get_string)  # -> out, a, b, c; inputs x: String; same code as c_script_3
context_print = ContextPrint(Validation_msg="this script opened and ran")
context_print_2 = ContextPrint(Gh_file_msg=c_script_4.out)
context_print_3 = ContextPrint(Gh_file=c_script_4.a)
panel_2 = Panel(c_script_3.a)  # disabled
