# Grasshopper definition test-script.gh (Grasshopper 1.0.8)

rectangle = Rectangle(Plane=PlaneXY(0, 0, 0), XSize=Domain(-1, 1), YSize=Domain(-2, 2), Radius=0)  # -> Rectangle, Length
area = Area(Geometry=rectangle.Rectangle)  # -> Area, Centroid
concat = Concatenate(FragmentA="IT", FragmentB="Can", FragmentA_2="work", FragmentB_2=area.Area)
context_print = ContextPrint(Test_output=concat)
