# Grasshopper definition Concat_Hops.gh (Grasshopper 1.0.8)

get_string = GetString(AtLeast=1, AtMost=1, TreeAccess=False)
get_integer = GetInteger(AtLeast=1, AtMost=1, Maximum=2147483647, Minimum=-2147483648, TreeAccess=False)
text = Text(get_integer)
concatenate = Concatenate(Fragment_A=get_string, A=" ", Fragment_B=text)
context_print = ContextPrint(Text=concatenate)
