# Grasshopper definition Test-Script-1.gh (Grasshopper 1.0.8)

X = Slider(2, range=-10..10)
Y = Slider(1, range=-10..10)
Z = Slider(0, range=-10..10)
R = Slider(3, range=0.1..10)
pt = Pt(XCoordinate=X, YCoordinate=Y, ZCoordinate=Z)
box = Box(Base=pt, X=R, Y=R, Z=R)
sph = Sph(Base=pt, Radius=R)
sdiff = SDiff(BrepsA=sph, BrepsB=box)
