# Grasshopper definition Test-Script-2.gh (Grasshopper 1.0.8)

A = Slider(10, range=0..20)
B = Slider(3, range=1..10)
C = Slider(0.5, range=0..1)
iter = Slider(3, range=0..10)
a_b = AB(A=A, B=B)
blur = Blur(Numbers=A, Strength=C, Iterations=iter, Lock=True, Wrap=False)
item = Item(List=blur, Index=A, Wrap=True)
divresult = Panel(a_b)
itemresult = Panel(item)
