# Grasshopper definition Test-Script-3.gh (Grasshopper 1.0.8)

hello = Panel("Hello")
world = Panel("world")
extra = Panel("!!")
joinstr = Panel(" ")
concat = Concat(FragmentA=hello, FragmentB=world)
merge = Merge(Data1=concat, Data2=extra)
join = Join(Text=merge, Join=joinstr)
result = Panel(join)
