# Grasshopper definition test_file_parser_01.gh (Grasshopper 1.0.8)
# plug-ins: RhinoCodePluginGH

panel = Panel("\"C:\\Users\\abawiskar\\Documents\\GitHub\\GH-Web-App\\gh file parser\\test_input_gh_01.gh\"")
c_script = CSharpScript(ghPathInput=panel)  # -> out, A
# ---------- c_script: C# ----------
// r "C:\Program Files\Rhino 8\System\Newtonsoft.Json.dll"

using System;
using System.IO;
using System.Collections.Generic;
using System.Linq;
using Grasshopper;
using Grasshopper.Kernel;
using Grasshopper.Kernel.Parameters;
using Newtonsoft.Json.Linq;

public class Script_Instance : GH_ScriptInstance
{
  private void RunScript(object ghPathInput, object y, ref object A)
  {
    // --- 0. Get and validate input path ---
    string ghPath = ghPathInput as string;
    if (string.IsNullOrWhiteSpace(ghPath))
    {
      A = "Please provide a .gh file path into input x.";
      return;
    }

    ghPath = ghPath.Trim('"');

    if (!File.Exists(ghPath))
    {
      A = $"File not found: {ghPath}";
      return;
    }

    // --- 1. Load GH document in memory ---
    var io = new GH_DocumentIO();
    bool ok = io.Open(ghPath);
    if (!ok || io.Document == null)
    {
      A = $"Failed to open Grasshopper file: {ghPath}";
      return;
    }

    GH_Document doc = io.Document;

    // --- 2. Build node map (IGH_DocumentObject -> integer Id) ---
    var objects = doc.Objects.ToList();
    var nodeMap = new Dictionary<IGH_DocumentObject, int>();
    for (int i = 0; i < objects.Count; i++)
      nodeMap[objects[i]] = i;

    var nodesArray = new JArray();

    // --- 3. Build node data (components + floating params like sliders/panels) ---
    foreach (var obj in objects)
    {
      int id = nodeMap[obj];

      var comp     = obj as IGH_Component;
      var docParam = obj as IGH_Param; // floating parameter (e.g. slider, panel, param_number, etc.)

      var node = new JObject
      {
        ["Id"]           = id,
        ["InstanceGuid"] = obj.InstanceGuid.ToString(),
        ["Name"]         = obj.Name,
        ["NickName"]     = obj.NickName,
        ["TypeName"]     = obj.GetType().FullName ?? obj.GetType().Name,
        ["IsComponent"]  = comp != null,
        ["IsParam"]      = docParam != null
      };

      // Canvas bounds for layout
      var b = obj.Attributes.Bounds;
      node["Bounds"] = new JObject
      {
        ["X"] = b.X,
        ["Y"] = b.Y,
        ["Width"] = b.Width,
        ["Height"] = b.Height
      };

      var inputsArray  = new JArray();
      var outputsArray = new JArray();

      // --- 3a. Component ports ---
      if (comp != null)
      {
        node["ComponentGuid"] = comp.ComponentGuid.ToString();
        node["Category"]      = comp.Category;
        node["SubCategory"]   = comp.SubCategory;

        // Component inputs
        foreach (var p in comp.Params.Input)
        {
          var port = new JObject
          {
            ["ParamGuid"] = p.InstanceGuid.ToString(),
            ["Name"]      = p.Name,
            ["NickName"]  = p.NickName,
            ["ParamType"] = p.GetType().FullName ?? p.GetType().Name,
            ["Access"]    = p.Access.ToString()
          };
          inputsArray.Add(port);
        }

        // Component outputs
        foreach (var p in comp.Params.Output)
        {
          var port = new JObject
          {
            ["ParamGuid"] = p.InstanceGuid.ToString(),
            ["Name"]      = p.Name,
            ["NickName"]  = p.NickName,
            ["ParamType"] = p.GetType().FullName ?? p.GetType().Name,
            ["Access"]    = p.Access.ToString()
          };
          outputsArray.Add(port);
        }
      }

      // --- 3b. Floating params (sliders, panels, value params, toggles, etc.) ---
      // These are IGH_Param objects that live directly on the canvas (not inside a component).
      if (docParam != null)
      {
        // Treat the param itself as a single "port" (usually an output).
        var port = new JObject
        {
          ["ParamGuid"] = docParam.InstanceGuid.ToString(),
          ["Name"]      = string.IsNullOrEmpty(docParam.Name) ? obj.Name : docParam.Name,
          ["NickName"]  = string.IsNullOrEmpty(docParam.NickName) ? obj.NickName : docParam.NickName,
          ["ParamType"] = docParam.GetType().FullName ?? docParam.GetType().Name,
          ["Access"]    = docParam.Access.ToString()
        };

        // For clarity, we put this port in Outputs.
        outputsArray.Add(port);
      }

      node["Inputs"]  = inputsArray;
      node["Outputs"] = outputsArray;

      nodesArray.Add(node);
    }

    // --- 4. Build edge list (connections) ---
    var edgesArray = new JArray();

    // 4a. Edges from component inputs (slider -> component, component -> component, etc.)
    foreach (var obj in objects)
    {
      var comp = obj as IGH_Component;
      if (comp == null)
        continue;

      int toNodeId = nodeMap[obj];

      foreach (var inputParam in comp.Params.Input)
      {
        Guid toParamGuid = inputParam.InstanceGuid;

        foreach (var srcParam in inputParam.Sources)
        {
          // NOTE: use DocObject here, not Owner
          var fromOwner = srcParam.Attributes.DocObject;
          if (!nodeMap.TryGetValue(fromOwner, out int fromNodeId))
            continue;

          edgesArray.Add(new JObject
          {
            ["FromNodeId"]    = fromNodeId,
            ["ToNodeId"]      = toNodeId,
            ["FromParamGuid"] = srcParam.InstanceGuid.ToString(),
            ["ToParamGuid"]   = toParamGuid.ToString()
          });
        }
      }
    }

    // 4b. Edges into floating params (e.g. component -> panel)
    foreach (var obj in objects)
    {
      var docParam = obj as IGH_Param;
      if (docParam == null)
        continue;

      int toNodeId = nodeMap[obj];
      Guid toParamGuid = docParam.InstanceGuid;

      foreach (var srcParam in docParam.Sources)
      {
        // NOTE: use DocObject here, not Owner
        var fromOwner = srcParam.Attributes.DocObject;
        if (!nodeMap.TryGetValue(fromOwner, out int fromNodeId))
          continue;

        edgesArray.Add(new JObject
        {
          ["FromNodeId"]    = fromNodeId,
          ["ToNodeId"]      = toNodeId,
          ["FromParamGuid"] = srcParam.InstanceGuid.ToString(),
          ["ToParamGuid"]   = toParamGuid.ToString()
        });
      }
    }

    // --- 5. Wrap everything in a root JSON object ---
    var root = new JObject
    {
      ["DocumentName"] = doc.DisplayName,
      ["DocumentPath"] = doc.FilePath,
      ["NodeCount"]    = nodesArray.Count,
      ["EdgeCount"]    = edgesArray.Count,
      ["Nodes"]        = nodesArray,
      ["Edges"]        = edgesArray
    };

    string json = root.ToString();

    // --- 6. Write to file next to the .gh file ---
    string dir       = Path.GetDirectoryName(ghPath) ?? Environment.CurrentDirectory;
    string nameNoExt = Path.GetFileNameWithoutExtension(ghPath);
    string outPath   = Path.Combine(dir, nameNoExt + "_graph.json");

    Directory.CreateDirectory(dir);
    File.WriteAllText(outPath, json);

    // --- 7. Status message ---
    A = $"Parsed GH file:\n  {ghPath}\n" +
        $"Nodes: {nodesArray.Count}, Edges: {edgesArray.Count}\n" +
        $"Graph JSON written to:\n  {outPath}";
  }
}
# ---------- end c_script ----------
