# Grasshopper definition test_file_parser_03.gh (Grasshopper 1.0.8)
# plug-ins: RhinoCodePluginGH

panel = Panel("\"C:\\Users\\abawiskar\\Documents\\GitHub\\GH-Web-App\\gh file parser\\test_input_gh_02.gh\"")
c_script = CSharpScript(ghPathInput=panel)  # -> out, A
# ---------- c_script: C# ----------
// r "C:\Program Files\Rhino 8\System\Newtonsoft.Json.dll"

using System;
using System.IO;
using System.Collections.Generic;
using System.Linq;
using Grasshopper;
using Grasshopper.Kernel;
using Grasshopper.Kernel.Parameters;
using Grasshopper.Kernel.Special;
using Newtonsoft.Json.Linq;

public class Script_Instance : GH_ScriptInstance
{
  private void RunScript(object ghPathInput, object y, ref object A)
  {
    // --- 0. Get and validate input path ---
    string ghPath = ghPathInput as string;
    if (string.IsNullOrWhiteSpace(ghPath))
    {
      A = "Please provide a .gh file path into input x.";
      return;
    }

    ghPath = ghPath.Trim('"');
    if (!File.Exists(ghPath))
    {
      A = $"File not found: {ghPath}";
      return;
    }

    // --- 1. Load GH document in memory ---
    var io = new GH_DocumentIO();
    bool ok = io.Open(ghPath);
    if (!ok || io.Document == null)
    {
      A = $"Failed to open Grasshopper file: {ghPath}";
      return;
    }

    GH_Document doc = io.Document;

    // --- 2. Collect nodes (components + floating params) ---
    var orderedObjects  = new List<IGH_DocumentObject>();
    var nodeIdByObject  = new Dictionary<IGH_DocumentObject, string>();
    var nicknameCounter = new Dictionary<string, int>();

    foreach (var obj in doc.Objects)
    {
      // Ignore groups, scribbles, etc.
      if (!(obj is IGH_Component) && !(obj is IGH_Param))
        continue;

      orderedObjects.Add(obj);

      // Base id from nickname or name, lowercased and sanitised
      string baseNick = !string.IsNullOrWhiteSpace(obj.NickName)
        ? obj.NickName
        : (!string.IsNullOrWhiteSpace(obj.Name) ? obj.Name : "node");

      baseNick = SanitizeId(baseNick.ToLowerInvariant());

      int count;
      if (!nicknameCounter.TryGetValue(baseNick, out count))
        count = 0;

      string id = (count == 0) ? baseNick : (baseNick + "_" + (count + 1));
      nicknameCounter[baseNick] = count + 1;

      nodeIdByObject[obj] = id;
    }

    // --- 3. Build nodes array ---
    var nodesArray = new JArray();

    foreach (var obj in orderedObjects)
    {
      string id = nodeIdByObject[obj];

      var node = new JObject();
      node["id"]       = id;

      // Component definition GUID (same for all instances of that type)
      Guid defGuid = Guid.Empty;
      var active = obj as IGH_ActiveObject;
      if (active != null)
        defGuid = active.ComponentGuid;

      node["guid"]     = (defGuid == Guid.Empty ? obj.InstanceGuid : defGuid).ToString();
      node["nickname"] = obj.NickName;
      node["x"]        = obj.Attributes.Pivot.X;
      node["y"]        = obj.Attributes.Pivot.Y;

      // Optional properties for sliders
      var slider = obj as GH_NumberSlider;
      if (slider != null)
      {
        var p = new JObject();
        p["Min"]   = slider.Slider.Minimum;
        p["Max"]   = slider.Slider.Maximum;
        p["Value"] = slider.Slider.Value;
        node["properties"] = p;
      }

      // (Add more special cases here if you want, e.g. toggles/panels)

      nodesArray.Add(node);
    }

    // --- 4. Build links array ---
    var linksArray = new JArray();

    // 4a. Component inputs (anything -> component)
    foreach (var obj in orderedObjects)
    {
      var comp = obj as IGH_Component;
      if (comp == null)
        continue;

      string toNodeId = nodeIdByObject[obj];

      foreach (var inputParam in comp.Params.Input)
      {
        string toParamName = SafeParamName(inputParam);

        foreach (var srcParam in inputParam.Sources)
        {
          var srcOwner = GetTopOwner(srcParam);
          if (srcOwner == null)
            continue;

          string fromNodeId;
          if (!nodeIdByObject.TryGetValue(srcOwner, out fromNodeId))
            continue; // only keep links where source is also a node

          string fromParamName = GetFromParamName(srcOwner, srcParam);

          var link = new JObject();
          link["fromNode"]  = fromNodeId;
          link["fromParam"] = fromParamName;
          link["toNode"]    = toNodeId;
          link["toParam"]   = toParamName;

          linksArray.Add(link);
        }
      }
    }

    // 4b. Floating param inputs (anything -> panel / other param)
    foreach (var obj in orderedObjects)
    {
      var param = obj as IGH_Param;
      if (param == null)
        continue;

      if (param.Sources.Count == 0)
        continue; // no incoming links

      string toNodeId    = nodeIdByObject[obj];
      string toParamName = SafeParamName(param);

      foreach (var srcParam in param.Sources)
      {
        var srcOwner = GetTopOwner(srcParam);
        if (srcOwner == null)
          continue;

        string fromNodeId;
        if (!nodeIdByObject.TryGetValue(srcOwner, out fromNodeId))
          continue;

        string fromParamName = GetFromParamName(srcOwner, srcParam);

        var link = new JObject();
        link["fromNode"]  = fromNodeId;
        link["fromParam"] = fromParamName;
        link["toNode"]    = toNodeId;
        link["toParam"]   = toParamName;

        linksArray.Add(link);
      }
    }

    // --- 5. Assemble root JSON ---
    var root = new JObject();
    root["nodes"] = nodesArray;
    root["links"] = linksArray;

    string json = root.ToString();

    // --- 6. Write JSON next to the .gh file ---
    string dir       = Path.GetDirectoryName(ghPath) ?? Environment.CurrentDirectory;
    string nameNoExt = Path.GetFileNameWithoutExtension(ghPath);
    string outPath   = Path.Combine(dir, nameNoExt + "_graph.json");

    Directory.CreateDirectory(dir);
    File.WriteAllText(outPath, json);

    // --- 7. Status message ---
    A = $"Parsed GH file:\n  {ghPath}\n" +
        $"nodes: {nodesArray.Count}, links: {linksArray.Count}\n" +
        $"Graph JSON written to:\n  {outPath}";
  }

  // --- helpers ---

  private static string SanitizeId(string s)
  {
    if (string.IsNullOrWhiteSpace(s))
      return "node";

    var chars = s.ToCharArray();
    for (int i = 0; i < chars.Length; i++)
    {
      char c = chars[i];
      if (!(char.IsLetterOrDigit(c) || c == '_' || c == '-'))
        chars[i] = '_';
    }
    return new string(chars);
  }

  private static string SafeParamName(IGH_Param p)
  {
    if (!string.IsNullOrWhiteSpace(p.NickName))
      return p.NickName;
    if (!string.IsNullOrWhiteSpace(p.Name))
      return p.Name;
    return "P";
  }

  // Sliders & other floating params: "0" as fromParam
  // Components: use the param NickName/Name
  private static string GetFromParamName(IGH_DocumentObject owner, IGH_Param srcParam)
  {
    if (owner is GH_NumberSlider || (owner is IGH_Param && !(owner is IGH_Component)))
    {
      return "0";
    }

    return SafeParamName(srcParam);
  }

  // Get top-level owner (component or canvas param) for a given param
  private static IGH_DocumentObject GetTopOwner(IGH_Param p)
  {
    if (p == null || p.Attributes == null)
      return null;

    // In your version, GetTopLevel is a PROPERTY, not a method
    var top = p.Attributes.GetTopLevel;  // <-- no parentheses
    if (top != null && top.DocObject != null)
      return top.DocObject;

    return p.Attributes.DocObject;
  }
}
# ---------- end c_script ----------
panel_2 = Panel(c_script.A)
